# Grasshopper definition CopilotDeployment.gh (Grasshopper 1.0.8)
# plug-ins: Pufferfish, Human, PlanFinderGH, LadybugGrasshopper, MetaHopper

# ----
# gif making
number_slider = Slider(29, range=0..29)
# how to run the prediction models:
# 
# - install xgboost to your grasshopper python environment, for me this folder is:
# 
# C:\Users\angel\.rhinocode\py39-rh8
# 
# there will be a python.exe in the right folder.
# 
# open powershell (not command prompt/terminal) and copy this line in there and run it (make sure you change it to your rhinocode python directory):
# 
# & "C:\Users\angel\.rhinocode\py39-rh8\python.exe" -m pip install xgboost
# 
# 
# for each prediction model:
# - update the path to each model and scaler you downloaded from google drive
panel = Panel("8.0")
dom = ConstructDomain(DomainStart=panel, DomainEnd="13.0")
random = Random(Range=dom, Number="2", Seed=number_slider)
item = ListItem(List=random, Index=0, Wrap=True)  # -> Item, Item1

# ----
# tech demo controls
# READMEEE
# steps:
# 
# 
# 0. you need xgboost installed to your rhino python. don't do #r, this will corrupt. install through pip in correct directory.
# 
# 1. set correct files:
# i've circled everything that needs files in green.
# within mrt prediction python component and pmv prediction component you need to point to the model and scaler .pkls. you then need to point to the json.
# 
# 2. toggle run prediction and spin ur LLM and gh_server.py, toggle run for LLM in grasshopper
# 
# 3. enter query or try the ones already there, slider above will change the grid you're viewing
furniture_grid_to_show = Slider(0, range=0..10)

# ----
# apartment to test
apartment_to_test = Slider(3, range=0..20)

# ----
# run prediction model?
falsestart = LBFalseStartToggle(True)

# ----
# plan generation stuff
rectangle = Rectangle(Plane=PlaneXY(0, 0, 0), XSize=item.Item, YSize=item.Item1, Radius=0)  # -> Rectangle, Length
crv = Curve(rectangle.Rectangle)
debrep = DeconstructBrep(Brep=crv)  # -> Faces, Edges, Vertices
item_2 = ListItem(List=debrep.Edges, Index="2", Wrap=True)
item_3 = ListItem(List=debrep.Edges, Index=0, Wrap=True)  # -> Item, Item1
merge = Merge(Data1=item_3.Item, Data2=item_3.Item1)
fsettings = FitSettings(
    WidthInterior=100,
    WidthExterior=200,
    DownScaling="0.8",
    UpScaling="1.2",
    ThresholdScore=0,
    AmountOptions="20",
    UnitSystem=4)
eval = EvaluateCurve(Curve=reparameterize(item_2), Parameter="0.2")  # -> Point, Tangent, Angle
fit = PlanFit(
    Boundary=crv,
    EntranceS=eval.Point,
    FacadeS=merge,
    Beds=-1,
    Baths=-1,
    Country=Slider(9, range=9..10),
    FitSettings=fsettings,
    InHousePlans=False)
deplan = DeconstructPlan(Plan=fit)  # -> InteriorWalls, ExteriorWalls, DoorCurves, Glass, WindowFrames, Furniture, Score, Rooms
panel_2 = Panel(deplan.Score)
deroom = DeconstructRoom(Room=deplan.Rooms)  # -> Boundary, InteriorBoundary, Function
panel_3 = Panel(deroom.Function)

# ----
# Promt Example 2: I sleep from 0:00 to 6:00.
# At 6:00 I scroll on my phone.
# At 7:00 I take a shower.
# At 8:00 I have a coffee.
# At 9:00 I relax and read a magazine.
# At 10:00 I watch Netflix.
# At 11:00 I work on my laptop.
# At 12:00 I cook lunch and eat at the dining table.
# At 13:00 I read a book.
# At 14:00 I nap.
# At 15:00 I do yoga.
# At 16:00 I write notes.
# At 17:00 I play video games.
# At 18:00 I chat with friends.
# At 19:00 I have dinner at the dining table.
# At 20:00 I read the newspaper.
# At 21:00 I rest.
# At 22:00 I scroll on my phone again.
# At 23:00 I sleep.
# I bought a desk so I can work on my laptop from 2pm to 6pm.
geo = Geometry(simplify([deplan.InteriorWalls, deplan.ExteriorWalls, deplan.DoorCurves, deplan.Glass, deplan.WindowFrames]))

# ----
# filter out livingrooms
crv_2 = Curve(simplify(graft(deroom.Boundary)))
trim = TrimTree(Tree=crv_2, Depth=1)
tmatch = MatchText(Text=deroom.Function, Pattern="Living", Case=True)  # -> graft(Match)
crv_3 = Curve(graft(trim))
cull = CullPattern(List=crv_3, CullPattern=tmatch)
clean = CleanTree(RemoveNulls=True, RemoveInvalid=True, RemoveEmpty=True, Tree=cull)

# ----
# Prompts
# Promt Example 1: At 0:00 I’m sleeping in bed. I continue sleeping until 6:00.
# At 6:00 I scroll on my phone while still in bed.
# At 7:00 I take a shower.
# At 8:00 I sit on the sofa, have a coffee, and listen to music.
# At 9:00 I watch Netflix and eat a snack on the sofa.
# At 10:00 I move to my desk and work on my laptop.
# At 11:00 I continue studying at the desk.
# At 12:00 I cook and eat lunch .
# At 13:00 I relax with a book in the armchair.
# At 14:00 I take a nap in bed.
# At 15:00 I do yoga on a yoga mat.
# At 16:00 I return to the desk to write notes.
# At 17:00 I play video games while sitting on the sofa.
# At 18:00 I chat with friends online, still on the sofa.
# At 19:00 I have dinner at the dining table.
# At 20:00 I read a magazine in the armchair.
# At 21:00 I rest and listen to music on the sofa.
# At 22:00 I scroll on my phone while lying in bed.
# At 23:00 I fall asleep.
# UI
# Promt Example 2: I usually wake up around 6am and scroll on my phone for a bit. By 7am, I have a coffee while listening to music. Around 8am, I work on my laptop and study until 12pm. At noon, I eat a snack while watching Netflix.
# 
# After lunch, I take a short nap around 1pm and then relax with a book until 2pm. Around 3pm, I do some yoga and then continue working on my laptop until 5pm. From 6pm to 7pm I play video games and chat with friends online. At 8pm, I read a magazine or the newspaper.
# 
# Around 9pm I rest on the sofa and listen to music again. By 10pm, I scroll on my phone and slowly get ready for bed. I’m usually sleeping from 11pm to 6am.
toggle = BooleanToggle(True)
py3 = Python3Script(run=toggle)  # -> out, prompt
# ---------- py3: Python ----------
import requests
import json

# Initialize the output variable
message = "The user preferences have not been generated yet"
print(message)

# Define the URL for the Flask server endpoint
url = 'http://127.0.0.1:5000/send_to_grasshopper'

# Get the response from the Flask server
message = requests.get(url)
response_data = message.json()  # Convert JSON string to a dictionary

# Extract the relevant part
received_message = response_data.get("response", "")  # Get the value of "response"
prompt = received_message.split(": ")[-1]  # Extract everything after ": "

# Print the output in the Grasshopper Python component
print(prompt)
# ---------- end py3 ----------
# LLM QUERY
panel_4 = Panel(py3.prompt)

panel_5 = Panel("can be red")
line = Line(deplan.DoorCurves)

# ----
# get doorlines
clean_2 = CleanTree(RemoveNulls=True, RemoveInvalid=True, RemoveEmpty=False, Tree=line)

# ----
# LLM CALLS
# METRATES
# FURNITURE
# ACTIVITIES
boolean_toggle = BooleanToggle(True)
python_3_script = Python3Script(prompt=panel_4, run=boolean_toggle)  # -> out, activities_json, flatten(hourly_mets), flatten(hourly_acts), hourly_furn
# ---------- python_3_script: Python ----------
import requests
import json

# Initialize outputs
activities_json = []
hourly_mets = []
hourly_acts = []
hourly_furn = []

if run:
    try:
        # Set up request
        url = "http://127.0.0.1:5000/extract_activities"
        headers = {"Content-Type": "application/json"}
        payload = {"prompt": prompt}

        # Send request
        res = requests.post(url, json=payload, headers=headers)
        res.raise_for_status()

        # Parse response
        data = res.json()

        print(" DATA RECEIVED FROM SERVER:")
        print(json.dumps(data, indent=2))

        # Extract each output list
        activities_json = data.get("activities_json", [])
        hourly_mets = data.get("hourly_metabolic_rates", [])
        hourly_acts = data.get("hourly_activities", [])
        hourly_furn = data.get("hourly_furniture", [])

        # Debug output lengths
        print("Hours:", len(hourly_mets), len(hourly_acts), len(hourly_furn))

    except Exception as e:
        print("ERROR:", e)
        activities_json = [str(e)]

# Assign to Grasshopper outputs
a = activities_json
b = hourly_mets
c = hourly_acts
d = hourly_furn
# ---------- end python_3_script ----------
metabolic_rates = Panel(python_3_script.hourly_mets)
activities = Panel(python_3_script.hourly_acts)
furniture = Panel(python_3_script.hourly_furn)

# ----
# assumes widest door is entrance door
len = Length(Curve=clean_2)
cset = CreateSet(List=len)  # -> Set, Map
lng = ListLength(List=cset.Set)
subtraction = Subtraction(A=lng, B=1)
equals = Equality(FirstNumber=cset.Map, SecondNumber=subtraction)  # -> Equality, Inequality
cull_2 = CullPattern(List=clean_2, CullPattern=equals.Equality)
item_4 = ListItem(List=cull_2, Index=0, Wrap=True)

tmatch_2 = MatchText(Text=furniture, RegEx="null", Case=True)
series = Series(Start=0, Step=1, Count="24")
cull_3 = CullPattern(List=series, CullPattern=tmatch_2)
replace = ReplaceItems(List=furniture, Indices=cull_3, Wrap=False)

# ----
# get the room the entry leads to
midpt = CurveMiddle(Curve=item_4)
incurves = PointInCurves(Point=midpt, Curves=deroom.Boundary)  # -> Relationship, Index, Point
item_5 = ListItem(List=deroom.Boundary, Index=incurves.Index, Wrap=True)
crv_4 = Curve(simplify(item_5))

# ----
# circulation
crv_5 = Curve(crv_4)

# ----
# split doors
crv_6 = Curve(simplify(clean_2))
len_2 = Length(Curve=crv_6)
similar = Similarity(FirstNumber=len_2, SecondNumber="0.8", Threshold=0.1)  # -> Similarity, AbsoluteDifference
similar_2 = Similarity(FirstNumber=len_2, SecondNumber="0.888", Threshold=0.1)  # -> Similarity, AbsoluteDifference
cull_4 = CullPattern(List=crv_6, CullPattern=similar.Similarity)
cull_5 = CullPattern(List=crv_6, CullPattern=similar_2.Similarity)

# ----
# living room / circ
# intersection segment
trim_2 = TrimTree(Tree=clean, Depth=1)
explode = Explode(Curve=crv_5, Recursive=True)  # -> simplify(Segments), Vertices
explode_2 = Explode(Curve=trim_2, Recursive=True)  # -> simplify(Segments), Vertices
py3_2 = Python3Script(treeA=explode_2.Segments, treeB=explode.Segments)  # -> out, overlapTree; inputs treeA: tree of Curve, treeB: tree of Curve
# ---------- py3_2: Python ----------
import Rhino.Geometry as rg
from Grasshopper import DataTree
from Grasshopper.Kernel.Data import GH_Path

# Inputs: treeA, treeB (set to Tree Access)
# Output: overlapTree (tree of booleans)

overlapTree = DataTree[bool]()

# Function to check if two curves overlap (more than just intersecting)
def curves_overlap(c1, c2, tol=1e-6):
    events = rg.Intersect.Intersection.CurveCurve(c1, c2, tol, tol)
    if events:
        for event in events:
            if event.IsOverlap:
                return True
    return False

# Go through each shared path
for path in treeA.Paths:
    if not treeB.PathExists(path):
        continue

    curvesA = treeA.Branch(path)
    curvesB = treeB.Branch(path)

    for ca in curvesA:
        found_overlap = False
        for cb in curvesB:
            if curves_overlap(ca, cb):
                found_overlap = True
                break
        overlapTree.Add(found_overlap, path)
# ---------- end py3_2 ----------
cull_6 = CullPattern(List=explode_2.Segments, CullPattern=py3_2.overlapTree)
crv_7 = Curve(simplify(cull_6))

# ----
# front doors
crv_8 = Curve(cull_5)

# ----
# interior doors
crv_9 = Curve(cull_4)

# ----
# check if living room has front door
midpt_2 = CurveMiddle(Curve=crv_8)
crv_10 = Curve(trim_2)
incurve = PointInCurve(Point=midpt_2, Curve=crv_10)  # -> Relationship, Point

# ----
# check for door on intersection(s)
join = JoinCurves(Curves=crv_7, Preserve=False)
py3_3 = Python3Script(TreeA=simplify(join), TreeB=crv_9)  # -> out, Overlaps; inputs TreeA: tree of Curve, TreeB: tree of Curve
# ---------- py3_3: Python ----------
import Rhino
import Grasshopper
from Grasshopper import DataTree
from Grasshopper.Kernel.Data import GH_Path

# Prepare output tree
result_tree = DataTree[bool]()

# Loop over TreeB branches
for i in range(TreeB.BranchCount):
    path = TreeB.Path(i)
    curves_b = TreeB.Branch(path)

    # Safely get TreeA branch (may be missing or empty)
    if i < TreeA.BranchCount:
        curves_a = TreeA.Branch(path)
    else:
        curves_a = []

    # If TreeA branch is empty or missing, mark all as False
    if not curves_a or len(curves_a) == 0:
        for _ in curves_b:
            result_tree.Add(False, path)
        continue

    curve_a = curves_a[0]  # still assuming one curve per branch in TreeA

    # Compare curve_a to each curve in TreeB branch
    for curve_b in curves_b:
        events = Rhino.Geometry.Intersect.Intersection.CurveCurve(curve_a, curve_b, 0.001, 0.001)
        overlap_found = False

        if events and events.Count > 0:
            for ev in events:
                if ev.IsOverlap:
                    overlap_found = True
                    break

        result_tree.Add(overlap_found, path)

# Output
Overlaps = result_tree
# ---------- end py3_3 ----------
ma = MassAddition(Input=py3_3.Overlaps)  # -> Result, PartialResults
bool = Boolean(ma.Result)

# ----
# living room crvs
crv_11 = Curve(simplify(trim_2))

# ----
# true facade point
join_2 = JoinCurves(Curves=merge, Preserve=False)
explode_3 = Explode(Curve=join_2, Recursive=True)  # -> Segments, Vertices
item_6 = ListItem(List=explode_3.Vertices, Index="1", Wrap=True)

# ----
# no front door, no door to circ
not = GateNot(A=incurve.Relationship)
not_2 = GateNot(A=bool)
and = GateAnd(A=not_2, B=not)
dispatch = Dispatch(List=trim_2, DispatchPattern=and)  # -> ListA, ListB
dispatch_2 = Dispatch(List=crv_5, DispatchPattern=and)  # -> ListA, ListB
explode_4 = Explode(Curve=dispatch.ListA, Recursive=True)  # -> simplify(Segments), Vertices
explode_5 = Explode(Curve=dispatch_2.ListA, Recursive=True)  # -> simplify(Segments), Vertices
clean_3 = CleanTree(RemoveNulls=True, RemoveInvalid=True, RemoveEmpty=True, Tree=explode_5.Segments)
py3_4 = Python3Script(treeA=explode_5.Segments, treeB=explode_4.Segments)  # -> out, overlapTree; inputs treeA: tree of Curve, treeB: tree of Curve; same code as py3_2
cull_7 = CullPattern(List=clean_3, CullPattern=py3_4.overlapTree)
crv_12 = Curve(simplify(cull_7))
midpt_3 = CurveMiddle(Curve=crv_12)
clean_4 = CleanTree(RemoveNulls=True, RemoveInvalid=True, RemoveEmpty=True, Tree=dispatch.ListA)
incurve_2 = PointInCurve(Point=midpt_3, Curve=clean_4)  # -> Relationship, Point
equals_2 = Equality(FirstNumber=incurve_2.Relationship, SecondNumber=1)  # -> Equality, Inequality
cull_8 = CullPattern(List=midpt_3, CullPattern=equals_2.Equality)

# ----
# intersections
bool_2 = Boolean(py3_3.Overlaps)

# ----
# interiordoors
crv_13 = Curve(crv_9)

# ----
# no front door, door to circ
not_3 = GateNot(A=incurve.Relationship)
and_2 = GateAnd(A=bool, B=not_3)
dispatch_3 = Dispatch(List=crv_13, DispatchPattern=and_2)  # -> ListA, ListB
dispatch_4 = Dispatch(List=bool_2, DispatchPattern=and_2)  # -> ListA, ListB
cull_9 = CullPattern(List=dispatch_3.ListA, CullPattern=dispatch_4.ListA)
midpt_4 = CurveMiddle(Curve=cull_9)

# ----
# front door in livingroom
bool_3 = Boolean(incurve.Relationship)
dispatch_5 = Dispatch(List=midpt_2, DispatchPattern=bool_3)  # -> ListA, ListB

# ----
# living room
branch = TreeBranch(Tree=crv_11, Path=apartment_to_test, MaintainPaths=True)

# ----
# planfinderplan
branch_2 = TreeBranch(Tree=geo, Path=apartment_to_test, MaintainPaths=True)

crv_14 = Curve(branch)

# ----
# get grid
brec = BoundingRectangle(Geometry=crv_14, Plane=PlaneXY(0, 0, 0), Axis=0, Slide=0, Union=True)  # -> Bounding, DimensionX, DimensionY
debrep_2 = DeconstructBrep(Brep=brec.Bounding)  # -> Faces, Edges, Vertices
sort_pt = SortPoints(Points=debrep_2.Vertices)  # -> Points, Indices
item_7 = ListItem(List=sort_pt.Points, Index=0, Wrap=True)
division = Division(A=brec.DimensionX, B="0.5")
division_2 = Division(A=brec.DimensionY, B="0.5")
sqgrid = Square(Plane=item_7, Size="0.5", ExtentX=division, ExtentY=division_2)  # -> flatten(Cells), Points
area = Area(Geometry=sqgrid.Cells)  # -> Area, Centroid
incurve_3 = PointInCurve(Point=area.Centroid, Curve=crv_14)  # -> Relationship, Point
cull_10 = CullPattern(List=area.Centroid, CullPattern=incurve_3.Relationship)
cull_11 = CullPattern(List=sqgrid.Cells, CullPattern=incurve_3.Relationship)

# ----
# gridsrf
srf = Surface(cull_11)

# ----
# gridpoints
pt = Point(cull_10)

# ----
# slab
srf_2 = Surface(crv_14)

panel_6 = Panel("https://energyplus-weather.s3.amazonaws.com/europe_wmo_region_6/ESP/ESP_Madrid.082210_SWEC/ESP_Madrid.082210_SWEC.zip")
downloadepw = LBDownloadWeather(weather_URL=panel_6)  # -> epw_file, stat_file, ddy_file; plug-in component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
data = Data(downloadepw.epw_file)
importepw = LBImportEPW(epw_file=data)  # -> location, dry_bulb_temperature, dew_point_temperature, relative_humidity, wind_speed, wind_direction, direct_normal_rad, diffuse_horizontal_rad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; plug-in component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

analysisperiod = LBAnalysisPeriod(start_month="6", start_day="21", start_hour=0, end_month="6", end_day="21")  # -> period, hoys, dates; plug-in component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

series_2 = Series(Start=0, Step=1, Count="24")
analysisperiod_2 = LBAnalysisPeriod(start_month="6", start_day="21", start_hour=series_2, end_month="6", end_day="21", end_hour=series_2)  # -> period, hoys, dates; plug-in component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

# ----
# n. gridpoints
lng_2 = ListLength(List=pt)

# ----
# dir_norm_rad per hour per gridpoint
applyper = LBApplyAnalysisPeriod(data=importepw.direct_normal_rad, period=analysisperiod.period)  # -> data; plug-in component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
xdata = LBDeconstructData(data=applyper)  # -> header, values; plug-in component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
dup = DuplicateData(Data=graft(xdata.values), Number=lng_2, Order=True)  # -> simplify(Data)
flip = FlipMatrix(Data=dup)  # -> graft(Data)

# ----
# diff_horiz_rad per hour per gridpoint
applyper_2 = LBApplyAnalysisPeriod(data=importepw.diffuse_horizontal_rad, period=analysisperiod.period)  # -> data; plug-in component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
xdata_2 = LBDeconstructData(data=applyper_2)  # -> header, values; plug-in component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
dup_2 = DuplicateData(Data=graft(xdata_2.values), Number=lng_2, Order=True)  # -> simplify(Data)
flip_2 = FlipMatrix(Data=dup_2)  # -> graft(Data)

# ----
# hour per gridpoint
panel_7 = Panel("24")
series_3 = Series(Start=0, Step=1, Count=panel_7)
dup_3 = DuplicateData(Data=graft(series_3), Number=lng_2, Order=True)  # -> simplify(Data)
flip_3 = FlipMatrix(Data=dup_3)  # -> graft(Data)

# ----
# "I wake up at around 7am and have my breakfast and get ready at 8am. Then I work from 9am to 5pm. I cook around 6pm, then I might watch a movie for two hours. At 9pm, just before bed, I'll do some yoga. Then I go to bed at 10pm."
dummy_test = Panel("""0.7
0.7
0.7
0.7
0.7
0.7
0.7
0.7
1
1.1
1.1
1.1
1.1
1.1
1.1
1.1
1.1
1.1
1.8
0.8
0.8
2.5
0.7
0.7""")

# ----
# rel_humid per hour per gridpoint
applyper_3 = LBApplyAnalysisPeriod(data=importepw.relative_humidity, period=analysisperiod.period)  # -> data; plug-in component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
xdata_3 = LBDeconstructData(data=applyper_3)  # -> header, values; plug-in component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
dup_4 = DuplicateData(Data=graft(xdata_3.values), Number=lng_2, Order=True)  # -> simplify(Data)
flip_4 = FlipMatrix(Data=dup_4)  # -> graft(Data)

# ----
# input from LLM
# (list of 24 metabolic rates)
data_2 = Data(metabolic_rates)
dup_5 = DuplicateData(Data=graft(data_2), Number=lng_2, Order=True)  # -> simplify(Data)
flip_5 = FlipMatrix(Data=dup_5)  # -> graft(Data)

# ----
# hour
data_3 = Data(flip_3)

# ----
# no beds
cset_2 = CreateSet(List=replace)  # -> Set, Map
tmatch_3 = MatchText(Text=flatten(cset_2.Set), RegEx="bed", Case=True)
not_4 = GateNot(A=tmatch_3)
cull_12 = CullPattern(List=cset_2.Set, CullPattern=not_4)  # -> simplify(graft(List))
set_of_furniture_bed = Panel(cull_12)
mindex = MemberIndex(Set=replace, Member=set_of_furniture_bed)  # -> simplify(Index), Count

# ----
# apartment lookup
# FURNITURE DATASET
crv_15 = Curve(crv_14)
brec_2 = BoundingRectangle(Geometry=crv_15, Plane=PlaneXY(0, 0, 0), Axis=0, Slide=0, Union=True)  # -> Bounding, DimensionX, DimensionY
explode_6 = Explode(Curve=brec_2.Bounding, Recursive=True)  # -> Segments, Vertices
len_3 = Length(Curve=explode_6.Segments)
bnd = Bounds(Numbers=len_3)
file_path = FilePath("C:\Users\chris\Desktop\AIAstudio_furniture-Copilot\grasshopperdeployment\all_apartment_layouts.json")
dedomain = DeconstructDomain(Domain=bnd)  # -> Start, End
python_3_script_2 = Python3Script(file_path=file_path, bounding_rectangle=brec_2.Bounding, b_x_in=brec_2.DimensionX, b_y_in=brec_2.DimensionY)  # -> out, apartment_id_out, furniture_names, furniture_points, furniture_rectangles, matched_b_x, matched_b_y; inputs bounding_rectangle: Curve, b_x_in: Double, b_y_in: Double
# ---------- python_3_script_2: Python ----------
import os
import json
import math
import Rhino.Geometry as rg
import rhinoscriptsyntax as rs

# Inputs:
# file_path: str
# b_x_in: float
# b_y_in: float
# bounding_rectangle: Guid (Curve or Surface)

# Outputs:
# furniture_names: list of str
# furniture_points: list of Point3d
# furniture_rectangles: list of Rectangle3d
# apartment_id_out: int
# layout_was_rotated: always False
# matched_b_x, matched_b_y

# --- Convert bounding rectangle
rect_geom = rs.coercegeometry(bounding_rectangle)
if rect_geom is None:
    raise ValueError("Bounding rectangle could not be resolved.")

success, plane = rect_geom.TryGetPlane()
if not success:
    raise ValueError("Bounding rectangle is not planar.")

bbox = rect_geom.GetBoundingBox(True)
width = bbox.Max.X - bbox.Min.X
height = bbox.Max.Y - bbox.Min.Y

if width == 0 or height == 0:
    raise ValueError("Bounding rectangle has zero width or height.")

# --- Load JSON
clean_path = os.path.normpath(file_path.strip('"'))
with open(clean_path, 'r') as f:
    data = json.load(f)

if b_x_in is None or b_y_in is None:
    raise ValueError("Input dimensions must be provided.")

# --- Match layout (no rotation)
def find_best_match(data, b_x_in, b_y_in):
    best = None
    min_dist = float('inf')
    for apt in data:
        a_x = apt.get("b_x", 0)
        a_y = apt.get("b_y", 0)
        dist = math.hypot(a_x - b_x_in, a_y - b_y_in)
        if dist < min_dist:
            best = apt
            min_dist = dist
    return best

selected_apartment = find_best_match(data, b_x_in, b_y_in)
layout_was_rotated = False

if not selected_apartment:
    raise ValueError("No matching apartment layout found.")

# --- Denormalization helper
def denormalize_xy(norm_x, norm_y, width, height, plane):
    x = norm_x * width
    y = norm_y * height
    return plane.Origin + plane.XAxis * x + plane.YAxis * y

# --- Extract furniture
furniture_names = []
furniture_points = []
furniture_rectangles = []

furniture = selected_apartment.get("furniture", [])

for item in furniture:
    name = item.get("furniture_name", "").strip()
    norm_x, norm_y = item.get("normalized_position", [0.0, 0.0])
    center = denormalize_xy(norm_x, norm_y, width, height, plane)

    furniture_names.append(name)
    furniture_points.append(center)

    # Reconstruct rectangle centered at normalized_position
    bbox_data = item.get("normalized_bbox", None)
    if bbox_data and len(bbox_data) == 2:
        (min_x, min_y), (max_x, max_y) = bbox_data
        box_width = (max_x - min_x) * width
        box_height = (max_y - min_y) * height

        # Create a plane whose origin is at the lower-left of the rectangle
        origin = center - (plane.XAxis * (box_width / 2)) - (plane.YAxis * (box_height / 2))
        rect_plane = rg.Plane(origin, plane.XAxis, plane.YAxis)

        rectangle = rg.Rectangle3d(rect_plane, box_width, box_height)
        furniture_rectangles.append(rectangle)
    else:
        furniture_rectangles.append(None)

# --- Metadata
apartment_id_out = selected_apartment["apartment_id"]
matched_b_x = selected_apartment["b_x"]
matched_b_y = selected_apartment["b_y"]
# ---------- end python_3_script_2 ----------

brep = Brep(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)

# ----
# sofa/table/rug (split)
panel_8 = Panel("sofa-table-rug")
brep_2 = Brep(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)

brep_3 = Brep(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)

brep_4 = Brep(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)

brep_5 = Brep(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)

brep_6 = Brep(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)

brep_7 = Brep(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)

# ----
# dining
panel_9 = Panel("4-seat-dining-table")
brep_8 = Brep(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)

brep_9 = Brep(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)

brep_10 = Brep(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)

brep_11 = Brep(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)

brep_12 = Brep(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)

brep_13 = Brep(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)

# ----
# surfaces
panel_10 = Panel("coffee-table-SQ")
brep_14 = Brep(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)

brep_15 = Brep(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)

brep_16 = Brep(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)

brep_17 = Brep(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)

brep_18 = Brep(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)

brep_19 = Brep(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)

brep_20 = Brep(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)

brep_21 = Brep(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)

brep_22 = Brep(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)

# ----
# kitchens
panel_11 = Panel("row-kitchen")
brep_23 = Brep(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)

# ----
# seating
panel_12 = Panel("desk-chair")
brep_24 = Brep(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)

brep_25 = Brep(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)

brep_26 = Brep(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)

brep_27 = Brep(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)

# ----
# storage
panel_13 = Panel("shelving")
brep_28 = Brep(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)

brep_29 = Brep(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)

# ----
# geometry
entwine = Entwine(
    Branch00=brep_23,
    Branch01=brep_20,
    Branch02=brep_21,
    Branch03=brep_3,
    Branch04=brep_4,
    Branch05=brep_7,
    Branch06=brep_5,
    Branch07=brep_10,
    Branch08=brep_6,
    Branch09=brep_12,
    Branch010=brep_8,
    Branch011=brep_9,
    Branch012=brep_11,
    Branch013=brep_14,
    Branch014=brep_18,
    Branch015=brep_22,
    Branch016=brep_29,
    Branch017=brep_26,
    Branch018=brep_24,
    Branch019=brep_27,
    Branch020=brep_17,
    Branch021=brep_19,
    Branch022=brep_15,
    Branch023=brep_16,
    Branch024=brep_28,
    Branch025=brep_25,
    Branch026=brep_13,
    Branch027=brep_2,
    Branch028=brep,
    FlattenInputs=True)

# ----
# names
entwine_2 = Entwine(
    Branch00=panel_11,
    Branch01="row-kitchen-S",
    Branch02="row-kitchen-L",
    Branch03="kitchen-island-stove",
    Branch04="kitchen-island-sink",
    Branch05="kitchen-island-L",
    Branch06="corner-kitchen-XL",
    Branch07="corner-kitchen-L",
    Branch08="corner-kitchen-L2",
    Branch09="corner-kitchen-S",
    Branch010=panel_9,
    Branch011="4-seat-round-dining-table",
    Branch012="6-seat-dining-table",
    Branch013=panel_10,
    Branch014="coffee-table-S",
    Branch015="coffee-table-L",
    Branch016="desk",
    Branch017="tv-stand",
    Branch018=panel_12,
    Branch019="armchair",
    Branch020="2-seater-sofa",
    Branch021="3-seater-sofa",
    Branch022="corner-sofa-LH",
    Branch023="corner-sofa-RH",
    Branch024=panel_13,
    Branch025="shelving-S",
    Branch026="bookcase-storage",
    Branch027=panel_8,
    Branch028="sofa-table-rug-2",
    FlattenInputs=True)

# ----
# rest of plan crvs
swatch = ColourSwatch(SwatchColor=RGBA(255, 255, 255, 131))
preview = CustomPreview(Geometry=branch_2, Material=swatch)

Z = UnitZ(Factor="0.01")

# ----
# living room entry point finding
# if living room:
# has no front door AND
# no door between circ and livingroom
# then:
# get circulation intersection line midpoint
# 
# if living room:
# has no front door AND
# door between circ and livingroom
# then:
# get door point
not_5 = GateNot(A=incurve.Relationship)
merge_2 = Merge(Data1=simplify(cull_8), Data2=simplify(midpt_4), Data3=simplify(dispatch_5.ListA))

# ----
# filter
and_3 = GateAnd(A=bool, B=not_5)
dispatch_6 = Dispatch(List=trim_2, DispatchPattern=and_3)  # -> ListA, ListB
dispatch_7 = Dispatch(List=crv_5, DispatchPattern=and_3)  # -> ListA, ListB
runion = RegionUnion(Curves=[dispatch_6.ListB, dispatch_7.ListB])
merge_3 = Merge(Data1=simplify(runion), Data2=simplify(dispatch_6.ListA))

# ----
# living rooms to test
crv_16 = Curve(merge_3)

area_2 = Area(Geometry=crv_16)  # -> Area, Centroid
sort = SortList(Keys=area_2.Area, ValuesA=crv_16)  # -> Keys, ValuesA
item_8 = ListItem(List=sort.ValuesA, Index="-1", Wrap=True)

# ----
# entry points
pt_2 = Point(merge_2)

# ----
# entry point
branch_3 = TreeBranch(Tree=pt_2, Path=apartment_to_test, MaintainPaths=True)

# ----
# get the corner facade point (between windows)
debrep_3 = DeconstructBrep(Brep=crv_11)  # -> Faces, Edges, Vertices

# ----
# livingroom points
pt_3 = Point(debrep_3.Vertices)

cp = ClosestPoint(Point=item_6, Cloud=pt_3)  # -> ClosestPoint, CPIndex, Distance

# ----
# point between facades
pt_4 = Point(simplify(cp.ClosestPoint))

# ----
# facade point
branch_4 = TreeBranch(Tree=pt_4, Path=apartment_to_test, MaintainPaths=True)

debrep_4 = DeconstructBrep(Brep=deplan.WindowFrames)  # -> Faces, Edges, Vertices
fline = FitLine(Points=debrep_4.Vertices)

# ----
# windowlines
crv_17 = Curve(fline)

trim_3 = TrimTree(Tree=crv_17, Depth=1)
midpt_5 = CurveMiddle(Curve=trim_3)

# ----
# get window points
incurve_4 = PointInCurve(Point=midpt_5, Curve=crv_11)  # -> Relationship, Point
dispatch_8 = Dispatch(List=trim_3, DispatchPattern=incurve_4.Relationship)  # -> ListA, ListB

# ----
# window crvs
crv_18 = Curve(simplify(dispatch_8.ListA))

# ----
# windowcrvs
branch_5 = TreeBranch(Tree=crv_18, Path=apartment_to_test, MaintainPaths=True)

# ----
# get context
windowheight = Slider(2, range=1..2)
Z_2 = UnitZ(Factor="0.6")
move = Move(Geometry=branch_5, Motion=Z_2)  # -> Geometry, Transform
Z_3 = UnitZ(Factor=Slider(3, range=0..10))
Z_4 = UnitZ(Factor=windowheight)
extr = Extrude(Base=crv_14, Direction=Z_3)
move_2 = Move(Geometry=crv_14, Motion=Z_3)  # -> Geometry, Transform
debrep_5 = DeconstructBrep(Brep=extr)  # -> graft(Faces), Edges, Vertices
extr_2 = Extrude(Base=move.Geometry, Direction=Z_4)
splitmul = SplitBrepMultiple(Brep=debrep_5.Faces, Cutters=extr_2)
lng_3 = ListLength(List=splitmul)
larger = LargerThan(FirstNumber=lng_3, SecondNumber=1)  # -> LargerThan, OrEqualTo
dispatch_9 = Dispatch(List=splitmul, DispatchPattern=larger.LargerThan)  # -> ListA, ListB
clean_5 = CleanTree(RemoveNulls=True, RemoveInvalid=True, RemoveEmpty=True, Tree=dispatch_9.ListB)
clean_6 = CleanTree(RemoveNulls=True, RemoveInvalid=True, RemoveEmpty=True, Tree=dispatch_9.ListA)
bbox = BoundingBox(Content=clean_6, Plane=PlaneXY(0, 0, 0))  # -> Box, Box_2
area_3 = Area(Geometry=bbox.Box)  # -> Area, Centroid
sort_2 = SortList(Keys=area_3.Area, ValuesA=clean_6)  # -> Keys, ValuesA
item_9 = ListItem(List=sort_2.ValuesA, Index="-1", Wrap=True)

# ----
# walls
srf_3 = Surface(clean_5)

# ----
# entry door cut (preview only)
explode_7 = Explode(Curve=crv_14, Recursive=True)  # -> Segments, Vertices
pt_5 = Point(branch_3)
pull = PullPoint(Point=branch_3, Geometry=explode_7.Segments, ClosestOnly=False)  # -> ClosestPoint, Distance, Index
smaller = SmallerThan(FirstNumber=pull.Distance, SecondNumber="0.001")  # -> SmallerThan, OrEqualTo
cull_13 = CullPattern(List=explode_7.Segments, CullPattern=smaller.SmallerThan)
crv_cp = CurveClosestPoint(Point=pt_5, Curve=cull_13)  # -> Point, Parameter, Distance
subtraction_2 = Subtraction(A=crv_cp.Parameter, B="0.4")
addition = Addition(A=crv_cp.Parameter, B="0.4")
eval_2 = EvaluateCurve(Curve=cull_13, Parameter=addition)  # -> Point, Tangent, Angle
eval_3 = EvaluateCurve(Curve=cull_13, Parameter=subtraction_2)  # -> Point, Tangent, Angle
ln = Line(StartPoint=eval_2.Point, EndPoint=eval_3.Point)
pull_2 = PullPoint(Point=branch_3, Geometry=srf_3, ClosestOnly=False)  # -> ClosestPoint, Distance, Index
Z_5 = UnitZ(Factor="2.4")
smaller_2 = SmallerThan(FirstNumber=pull_2.Distance, SecondNumber="0.001")  # -> SmallerThan, OrEqualTo
extr_3 = Extrude(Base=ln, Direction=Z_5)
cull_14 = CullPattern(List=srf_3, CullPattern=smaller_2.SmallerThan)
dispatch_10 = Dispatch(List=srf_3, DispatchPattern=smaller_2.SmallerThan)  # -> ListA, ListB
split = SplitBrep(Brep=dispatch_10.ListA, Cutter=extr_3)
area_4 = Area(Geometry=split)  # -> Area, Centroid
sort_3 = SortList(Keys=area_4.Area, ValuesA=split)  # -> Keys, ValuesA
item_10 = ListItem(List=sort_3.ValuesA, Index="-1", Wrap=True)
srf_4 = Surface(item_10)
merge_4 = Merge(Data1=dispatch_10.ListB, Data2=srf_4)  # -> simplify(Result)

# ----
# windows
srf_5 = Surface(item_9)

# ----
# roof
srf_6 = Surface(move_2.Geometry)

merge_5 = Merge(Data1=srf_2, Data2=srf_6, Data3=srf_5, Data4=srf_3)  # -> flatten(Result)

# ----
# context
geo_2 = Geometry(merge_5)

# ----
# human2sky analysis per hour per gridpoint
panel_14 = Panel("21")
analysisperiod_3 = LBAnalysisPeriod(start_month="6", start_day=panel_14, start_hour=0, end_month="6", end_day=panel_14, end_hour=23)  # -> period, hoys, dates; plug-in component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
humantosky = LBHumanToSkyRelation(
    location=importepw.location,
    position=flatten(pt),
    context=flatten(geo_2),
    pt_count="3",
    hoy=analysisperiod_3.hoys,
    run=falsestart)  # -> report, human_points, human_line, simplify(fract_body_exp), simplify(sky_exposure); plug-in component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
flip_6 = FlipMatrix(Data=humantosky.fract_body_exp)  # -> graft(Data)
flip_7 = FlipMatrix(Data=humantosky.sky_exposure)  # -> graft(Data)

# ----
# indoor_mrt input
# indoor_mrt prediction
merge_6 = Merge(Data1=flip_3, Data2=flip, Data3=flip_2, Data4=flip_6, Data5=flip_7)

# ----
# actual value calc (slow)
applyper_4 = LBApplyAnalysisPeriod(data=importepw.diffuse_horizontal_rad, period=analysisperiod_2.period)  # -> data; disabled; plug-in component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
applyper_5 = LBApplyAnalysisPeriod(data=importepw.direct_normal_rad, period=analysisperiod_2.period)  # -> data; disabled; plug-in component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
trim_4 = TrimTree(Tree=flip_6, Depth=1)  # disabled
trim_5 = TrimTree(Tree=flip_7, Depth=1)  # disabled
panel_15 = Panel("0.25")  # disabled
panel_16 = Panel("22")  # disabled
panel_17 = Panel("0.4")  # disabled
falsestart_2 = LBFalseStartToggle(False)  # disabled
indoorsolarmrt = LBIndoorSolarMRT(
    location=importepw.location,
    longwave_mrt=panel_16,
    dir_norm_rad=applyper_5,
    diff_horiz_rad=applyper_4,
    fract_body_exp=trim_4,
    sky_exposure=trim_5,
    ground_ref=panel_15,
    window_trans=panel_17,
    run=falsestart_2)  # -> report, erf, dmrt, mrt; disabled; plug-in component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
xdata_4 = LBDeconstructData(data=indoorsolarmrt.mrt)  # -> header, simplify(values); disabled; plug-in component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
toggle_2 = GroupToggle(ToggleActive=True, ToggleVisible=False)  # disabled

# ----
# indoor mrt prediction model
python_3_script_3 = Python3Script(inputs=merge_6)  # -> out, graft(a); inputs inputs: tree
# ---------- python_3_script_3: Python ----------
# r: pandas, scikit-learn

#THIS IS NECESSARY TO LOAD PANDAS otherwise it bugs
import locale
locale.setlocale(locale.LC_ALL, 'en_US')

import pickle
import pandas as pd
import numpy as np
import sklearn as sk
import ghpythonlib.treehelpers as ghth

print("ok")

# LOAD TREE AS NUMPY ARRAY
# TREE SHOULD NOT BE SIMPLIFIED, OTHERWISE IT RETURNS ONLY FIRST BRANCH (Rhino bug)
X = np.array([inputs.Branch(i) for i in range(inputs.BranchCount)])
print("Input shape:", X.shape)  # Should be (72, 5)



# LOAD SCALER
pathScaler = r'C:\Users\chris\Desktop\AIAstudio_furniture-Copilot\grasshopperdeployment\mrt_scaler.pkl'
with open(pathScaler, 'rb') as file:
    Sscaler = pickle.load(file)

X_scaled = Sscaler.transform(X)

# LOAD POLYNOMIAL REGRESSION MODEL
pathModel = r'C:\Users\chris\Desktop\AIAstudio_furniture-Copilot\grasshopperdeployment\mrt_xgb_model.pkl'
with open(pathModel, 'rb') as file:
    regModel = pickle.load(file)

# PREDICT
predictions = regModel.predict(X_scaled)

# COMPILE OUTPUT DATAFRAME (OPTIONAL)
# Ensure the column names match your model input (for your own reference or debugging)
data = pd.DataFrame(X, columns=[
    "IN:hour",
    "IN:dir_norm_rad",
    "IN:diff_horiz_rad",
    "IN:fract_body_exp",
    "IN:sky_exp"
])
data["predicted_MRT"] = predictions
print(data)

# OPTIONAL: Export results
#data.to_csv(r"C:\Path\To\Your\Output\mrt_predictions.csv", index=False)

# RETURN TO GRASSHOPPER
a = ghth.list_to_tree(predictions.tolist())
# ---------- end python_3_script_3 ----------
match = MatchTree(Tree=python_3_script_3.a, Guide=merge_6)
data_4 = Data(match)

predicted = Panel(data_4)
actual = Panel(xdata_4.values)

# ----
# indoor_mrt
data_5 = Data(data_4)

# ----
# pmv_score prediction
# pmv_score input
merge_7 = Merge(Data1=data_3, Data2=flip_5, Data3=data_5, Data4=flip_4)

# ----
# actual value calc (slow)
applyper_6 = LBApplyAnalysisPeriod(data=importepw.relative_humidity, period=analysisperiod_2.period)  # -> data; disabled; plug-in component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
trim_6 = TrimTree(Tree=flip_5, Depth=1)  # disabled
trim_7 = TrimTree(Tree=data_5, Depth=1)  # disabled
panel_18 = Panel("0.1")  # disabled
panel_19 = Panel("22")  # disabled
falsestart_3 = LBFalseStartToggle(False)  # disabled
pmv = LBPMVComfort(air_temp=panel_19, mrt=trim_7, rel_humid=applyper_6, air_speed=panel_18, met_rate=trim_6, run=falsestart_3)  # -> report, pmv, ppd, set, comfort, condition, heat_loss, comf_obj; disabled; plug-in component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
xdata_5 = LBDeconstructData(data=pmv.pmv)  # -> header, simplify(values); disabled; plug-in component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
toggle_3 = GroupToggle(ToggleActive=True, ToggleVisible=False)  # disabled

# ----
# pmv_score prediction
python_3_script_4 = Python3Script(inputs=merge_7)  # -> out, graft(a); inputs inputs: tree
# ---------- python_3_script_4: Python ----------
# r: pandas

# This is necessary to load pandas, otherwise it bugs
import locale
locale.setlocale(locale.LC_ALL, 'en_US')

import pickle
import pandas as pd
import numpy as np
import ghpythonlib.treehelpers as ghth

print("ok")

# LOAD TREE AS NUMPY ARRAY
# TREE SHOULD NOT BE SIMPLIFIED, OTHERWISE IT RETURNS ONLY FIRST BRANCH (Rhino bug)
X = np.array([inputs.Branch(i) for i in range(inputs.BranchCount)])
print("Input shape:", X.shape)  # Should be (72, 4) for PMV model

# LOAD SCALER
pathScaler = r'C:\Users\chris\Desktop\AIAstudio_furniture-Copilot\grasshopperdeployment\pmv_scaler.pkl'
with open(pathScaler, 'rb') as file:
    Sscaler = pickle.load(file)

X_scaled = Sscaler.transform(X)

# LOAD XGBOOST MODEL (NO SCALER NEEDED)
pathModel = r'C:\Users\chris\Desktop\AIAstudio_furniture-Copilot\grasshopperdeployment\pmv_xgb_model.pkl'
with open(pathModel, 'rb') as file:
    xgb_model = pickle.load(file)

# PREDICT PMV
predictions = xgb_model.predict(X_scaled)

# COMPILE OUTPUT DATAFRAME (OPTIONAL)
# Update column names to match PMV model input
data = pd.DataFrame(X, columns=[
    "IN:hour",
    "IN:met_rate",
    "IN:indoor_mrt",
    "IN:rel_humid"
])
data["predicted_PMV"] = predictions
print(data)

# RETURN TO GRASSHOPPER
a = ghth.list_to_tree(predictions.tolist())
# ---------- end python_3_script_4 ----------
match_2 = MatchTree(Tree=python_3_script_4.a, Guide=merge_7)

# ----
# prediction out
data_6 = Data(match_2)

# ----
# comfort grid for each furniture
py3_5 = Python3Script(Values=data_6, Mask=mindex.Index)  # -> out, Result; inputs Values: tree, Mask: tree
# ---------- py3_5: Python ----------
from Grasshopper import DataTree
from Grasshopper.Kernel.Data import GH_Path

Result = DataTree[object]()

# Preprocess masks into a dict of sets for fast lookup
mask_dict = {}
for i, mask_branch in enumerate(Mask.Branches):
    mask_dict[i] = set(mask_branch)

# Loop through each path in Values
for path in Values.Paths:
    # Skip empty branches
    items = Values.Branch(path)
    if not items:
        continue

    gridpoint = path[0]
    hour = path[1]
    value = items[0]

    # Try all masks
    for i, hour_set in mask_dict.items():
        if hour in hour_set:
            new_path = GH_Path(i, gridpoint, hour)
            Result.Add(value, new_path)
# ---------- end py3_5 ----------
trim_8 = TrimTree(Tree=py3_5.Result, Depth=1)
tstat = TreeStatistics(Tree=mindex.Index)  # -> Paths, Length, Count
ma_2 = MassAddition(Input=trim_8)  # -> Result, PartialResults
series_4 = Series(Start=0, Step=1, Count=tstat.Count)
abs = Absolute(Value=ma_2.Result)
item_11 = ListItem(List=series_4, Index=furniture_grid_to_show, Wrap=True)
trim_9 = TrimTree(Tree=abs, Depth=1)
branch_6 = TreeBranch(Tree=trim_9, Path=item_11, MaintainPaths=True)
bnd_2 = Bounds(Numbers=branch_6)
dedomain_2 = DeconstructDomain(Domain=bnd_2)  # -> Start, End
gradient = Gradient(
    LowerLimit=dedomain_2.Start,
    UpperLimit=dedomain_2.End,
    Parameter=branch_6,
    stops=[0: RGB(0, 255, 0), 0.498: RGB(255, 255, 0), 1: RGB(255, 0, 0)])
top_to_check = Slider(5, range=1..50)
branch_7 = TreeBranch(Tree=gradient, Path=item_11, MaintainPaths=True)
lng_4 = ListLength(List=branch_7)
division_3 = Division(A="100", B=top_to_check)
srf_7 = Surface(srf)
sort_4 = SortList(Keys=branch_6, ValuesA=srf_7)  # -> Keys, ValuesA
division_4 = Division(A=lng_4, B=division_3)
split_2 = SplitList(List=sort_4.ValuesA, Index=division_4)  # -> ListA, ListB

# ----
# drawing best places
cset_3 = CreateSet(List=python_3_script_2.furniture_names)  # -> Set, Map
tmatch_4 = MatchText(Text=cset_3.Set, RegEx=cull_12, Case=True)
pt_6 = Point(python_3_script_2.furniture_points)
crv_19 = Curve(python_3_script_2.furniture_rectangles)
cull_15 = CullPattern(List=pt_6, CullPattern=tmatch_4)  # -> simplify(List)
lng_5 = ListLength(List=cull_15)
bool_4 = Boolean(lng_5)
pcen = PolygonCenter(Polyline=srf_7)  # -> CenterV, CenterE, CenterA
sort_5 = SortList(Keys=trim_9, ValuesA=pcen.CenterV)  # -> Keys, ValuesA
item_12 = ListItem(List=sort_5.ValuesA, Index=0, Wrap=True)
vec2pt = Vector2Pt(PointA=cull_15, PointB=item_12, Unitize=False)  # -> Vector, Length
dispatch_11 = Dispatch(List=set_of_furniture_bed, DispatchPattern=bool_4)  # -> ListA, ListB
clean_7 = CleanTree(RemoveNulls=True, RemoveInvalid=True, RemoveEmpty=True, Tree=dispatch_11.ListB)
tstat_2 = TreeStatistics(Tree=clean_7)  # -> graft(Paths), Length, Count
branch_8 = TreeBranch(Tree=item_12, Path=tstat_2.Paths, MaintainPaths=True)

branch_9 = TreeBranch(Tree=cull_12, Path=item_11, MaintainPaths=True)
concat = Concatenate(FragmentA="Current grid view: most comfortable spots for ", FragmentB=branch_9, FragmentC="Based on your schedule input")
concat_2 = Concatenate(FragmentA=Slider(13, range=0..100), FragmentB=Slider(63, range=0..100), JoinSeparator=", ")

# ----
# nametags
# rectangles
panel_20 = Panel("0.1")
Z_6 = UnitZ(Factor=panel_20)
move_3 = Move(Geometry=pt_6, Motion=Z_6)  # -> Geometry, Transform
swatch_2 = ColourSwatch(SwatchColor=RGB(0, 0, 0))
panel_21 = Panel("0.15")
preview_2 = CustomPreview(Geometry=crv_19, Material=swatch_2)
tag = TextTag(Location=move_3.Geometry, Text=python_3_script_2.furniture_names, Colour=swatch_2)

# ----
# movement arrows
move_4 = Move(Geometry=cull_15, Motion=Z_6)  # -> Geometry, Transform
vdis = VectorDisplay(Anchor=move_4.Geometry, Vector=vec2pt.Vector)

# ----
# previews
# living room outline
brep_30 = Brep(extr)
debrep_6 = DeconstructBrep(Brep=brep_30)  # -> Faces, flatten(Edges), Vertices
previewlw = CustomPreviewLineweights(Geometry=debrep_6.Edges, Shader=ColourSwatch(SwatchColor=RGB(255, 255, 255)), Thickness="3", Absolute=False)

# ----
# top 5% spots
swatch_3 = ColourSwatch(SwatchColor=RGB(0, 255, 255))
preview_3 = CustomPreview(Geometry=split_2.ListA, Material=swatch_3)

# ----
# living room walls
swatch_4 = ColourSwatch(SwatchColor=RGBA(255, 255, 255, 72))
preview_4 = CustomPreview(Geometry=[srf_5, merge_4], Material=swatch_4)

# ----
# screen text
panel_22 = Panel("20")
texttoscreen = RenderTextToScreen(Text=concat, Location=concat_2, Size=panel_22, Color=ColourSwatch(SwatchColor=RGB(255, 255, 255)), m_scWithvp=False)

# ----
# comfort grid
preview_5 = CustomPreview(Geometry=srf_7, Material=gradient)

# ----
# furniture geometry
tmatch_5 = MatchText(Text=graft(python_3_script_2.furniture_names), Pattern=flatten(entwine_2), Case=True)  # -> simplify(Match)
cull_16 = CullPattern(List=flatten(entwine), CullPattern=tmatch_5)  # -> flatten(List)
brec_3 = BoundingRectangle(Geometry=cull_16, Plane=PlaneXY(0, 0, 0), Axis=0, Slide=0, Union=False)  # -> Bounding, DimensionX, DimensionY
py3_6 = Python3Script(geometry=cull_16, source_rect=brec_3.Bounding, target_rect=python_3_script_2.furniture_rectangles)  # -> out, out_geometry, xform; inputs geometry: list of Brep, source_rect: list of Curve, target_rect: list of Curve
# ---------- py3_6: Python ----------
import Rhino.Geometry as rg
import math

out_geometry = []
xforms = []

def rotate_if_needed(brep, source_rect, target_rect):
    """Rotate geometry 90 degrees if source and target rectangles differ in orientation."""

    # Get widths and heights
    success_s, poly_s = source_rect.TryGetPolyline()
    success_t, poly_t = target_rect.TryGetPolyline()
    if not success_s or not success_t:
        return None, None

    def get_dims(poly):
        x = (poly[1] - poly[0]).Length
        y = (poly[3] - poly[0]).Length
        return x, y

    sx, sy = get_dims(poly_s)
    tx, ty = get_dims(poly_t)

    # Determine if rotation is needed (by comparing aspect ratios)
    rot_needed = (sx > sy and tx < ty) or (sx < sy and tx > ty)

    # Build center-aligned transform
    center_s = rg.AreaMassProperties.Compute(poly_s.ToNurbsCurve()).Centroid
    center_t = rg.AreaMassProperties.Compute(poly_t.ToNurbsCurve()).Centroid

    geo_copy = brep.Duplicate()

    if rot_needed:
        rot = rg.Transform.Rotation(math.pi / 2, rg.Vector3d.ZAxis, center_s)
        geo_copy.Transform(rot)

    # Move to target center
    move = rg.Transform.Translation(center_t - center_s)
    geo_copy.Transform(move)

    final_xform = rot * move if rot_needed else move

    return geo_copy, final_xform

# MAIN
count = min(len(geometry), len(source_rect), len(target_rect))
for i in range(count):
    geo = geometry[i]
    src = source_rect[i]
    tgt = target_rect[i]

    if geo and src and tgt:
        result, xform = rotate_if_needed(geo, src, tgt)
        out_geometry.append(result)
        xforms.append(xform)
    else:
        out_geometry.append(None)
        xforms.append(None)
# ---------- end py3_6 ----------
brep_31 = Brep(py3_6.out_geometry)

move_5 = Move(Geometry=brep_31, Motion=Z)  # -> Geometry, Transform

preview_6 = CustomPreview(Geometry=move_5.Geometry, Material=ColourSwatch(SwatchColor=RGB(105, 105, 105)))

# ----
# placement arrows
panel_23 = Panel("5")
Z_7 = UnitZ(Factor=panel_23)
move_6 = Move(Geometry=branch_8, Motion=Z_7)  # -> Geometry, Transform

# ----
# 'best for...'
panel_24 = Panel("0.3")
Z_8 = UnitZ(Factor=panel_24)
move_7 = Move(Geometry=move_6.Geometry, Motion=Z_8)  # -> Geometry, Transform
concat_3 = Concatenate(FragmentA="Best for ", FragmentB=clean_7)
swatch_5 = ColourSwatch(SwatchColor=RGB(255, 0, 158))
panel_25 = Panel("0.2")
tag_2 = TextTag(Location=move_7.Geometry, Text=concat_3, Colour=swatch_5)

ln_2 = Line(StartPoint=move_6.Geometry, EndPoint=branch_8)

previewlw_2 = CustomPreviewLineweights(Geometry=ln_2, Shader=swatch_5, Thickness="3", Absolute=False)
dots = DotDisplay(Point=branch_8, Colour=swatch_5, Size="0.2")
