# Grasshopper definition LivingRoomEncoding.gh (Grasshopper 1.0.8)
# plug-ins: CORE.Toolbox.Grasshopper, treesloth01, Pufferfish, Human, PlanFinderGH, LadybugGrasshopper

# ----
# iterator
batch_number = Slider(1, range=1..40)
toggle = BooleanToggle(False)
dom = ConstructDomain(DomainStart="8.0", DomainEnd="12.0")
dom_2 = ConstructDomain(DomainStart="6.0", DomainEnd="15.0")
dom_3 = ConstructDomain(DomainStart="0.1", DomainEnd="0.9")
random = Random(Range=dom, Number="1", Seed=batch_number)
random_2 = Random(Range=dom_2, Number="1", Seed=batch_number)
random_3 = Random(Range=dom_3, Number="1", Seed=batch_number)
brute = BruteForceClassic(Run=toggle, NumberSliders=batch_number)
roundd = RoundToDecimalPlace(NumberX=random, DecimalPlace="1", RoundType=0)  # -> Rounded, Difference
roundd_2 = RoundToDecimalPlace(NumberX=random_2, DecimalPlace="1", RoundType=0)  # -> Rounded, Difference
roundd_3 = RoundToDecimalPlace(NumberX=random_3, DecimalPlace="1", RoundType=0)  # -> Rounded, Difference
rectangle = Rectangle(Plane=PlaneXY(0, 0, 0), XSize=roundd.Rounded, YSize=roundd_2.Rounded, Radius=0)  # -> Rectangle, Length

# ----
# setup
crv = Curve(rectangle.Rectangle)
debrep = DeconstructBrep(Brep=crv)  # -> Faces, Edges, Vertices
item = ListItem(List=debrep.Edges, Index="2", Wrap=True)
item_2 = ListItem(List=debrep.Edges, Index=0, Wrap=True)  # -> Item, Item1
# ITERATIONS
eval = EvaluateCurve(Curve=reparameterize(item), Parameter=roundd_3.Rounded)  # -> Point, Tangent, Angle
merge = Merge(Data1=item_2.Item, Data2=item_2.Item1)
fsettings = FitSettings(
    WidthInterior=100,
    WidthExterior=200,
    DownScaling="0.8",
    UpScaling="1.2",
    ThresholdScore=0,
    AmountOptions="20",
    UnitSystem=4)
fit = PlanFit(
    Boundary=crv,
    EntranceS=eval.Point,
    FacadeS=merge,
    Beds=-1,
    Baths=-1,
    Country=Slider(9, range=9..10),
    FitSettings=fsettings,
    InHousePlans=False)

# ----
# recorder
rec = DataRecorder(fit, DataLimit=-10, RecordData=True)
filter = StreamFilter(Gate=toggle, Stream0=rec)

# ----
# only include if unique
deplan = DeconstructPlan(Plan=simplify(graft(filter)))  # -> InteriorWalls, ExteriorWalls, DoorCurves, Glass, WindowFrames, Furniture, Score, Rooms
cset = CreateSet(List=flatten(deplan.Score))  # -> Set, Map
cset_2 = CreateSet(List=cset.Map)  # -> Set, Map
branch = TreeBranch(Tree=simplify(graft(filter)), Path=cset_2.Set, MaintainPaths=True)
renumber = RenumberPaths(Data=branch)

panel = Panel(deplan.Score)
deplan_2 = DeconstructPlan(Plan=renumber)  # -> InteriorWalls, ExteriorWalls, DoorCurves, Glass, WindowFrames, Furniture, Score, Rooms
deroom = DeconstructRoom(Room=deplan_2.Rooms)  # -> Boundary, InteriorBoundary, Function
merge_2 = Merge(
    Data1=deplan_2.InteriorWalls,
    Data2=deplan_2.ExteriorWalls,
    Data3=deplan_2.DoorCurves,
    Data4=deplan_2.Glass,
    Data5=deplan_2.WindowFrames,
    Data6=deplan_2.Furniture)

# ----
# filter out livingrooms
crv_2 = Curve(simplify(graft(deroom.Boundary)))
trim = TrimTree(Tree=crv_2, Depth=1)
tmatch = MatchText(Text=deroom.Function, Pattern="Living", Case=True)  # -> graft(Match)
crv_3 = Curve(graft(trim))
cull = CullPattern(List=simplify(crv_3), CullPattern=simplify(tmatch))
clean = CleanTree(RemoveNulls=True, RemoveInvalid=True, RemoveEmpty=True, Tree=cull)

panel_2 = Panel("can be red")
line = Line(deplan_2.DoorCurves)

# ----
# get doorlines
clean_2 = CleanTree(RemoveNulls=True, RemoveInvalid=True, RemoveEmpty=False, Tree=line)

# ----
# assumes widest door is entrance door
len = Length(Curve=clean_2)
cset_3 = CreateSet(List=len)  # -> Set, Map
lng = ListLength(List=cset_3.Set)
subtraction = Subtraction(A=lng, B=1)
equals = Equality(FirstNumber=cset_3.Map, SecondNumber=subtraction)  # -> Equality, Inequality
cull_2 = CullPattern(List=clean_2, CullPattern=equals.Equality)
item_3 = ListItem(List=cull_2, Index=0, Wrap=True)

# ----
# get the room the entry leads to
midpt = CurveMiddle(Curve=item_3)
incurves = PointInCurves(Point=midpt, Curves=deroom.Boundary)  # -> Relationship, Index, Point
item_4 = ListItem(List=deroom.Boundary, Index=incurves.Index, Wrap=True)
crv_4 = Curve(simplify(item_4))

# ----
# circulation
crv_5 = Curve(crv_4)

# ----
# split doors
crv_6 = Curve(simplify(clean_2))
len_2 = Length(Curve=crv_6)
similar = Similarity(FirstNumber=len_2, SecondNumber="0.8", Threshold=0.1)  # -> Similarity, AbsoluteDifference
similar_2 = Similarity(FirstNumber=len_2, SecondNumber="0.888", Threshold=0.1)  # -> Similarity, AbsoluteDifference
cull_3 = CullPattern(List=crv_6, CullPattern=similar.Similarity)
cull_4 = CullPattern(List=crv_6, CullPattern=similar_2.Similarity)

# ----
# living room / circ
# intersection segment
trim_2 = TrimTree(Tree=clean, Depth=1)
explode = Explode(Curve=crv_5, Recursive=True)  # -> simplify(Segments), Vertices
explode_2 = Explode(Curve=trim_2, Recursive=True)  # -> simplify(Segments), Vertices
py3 = Python3Script(treeA=explode_2.Segments, treeB=explode.Segments)  # -> out, overlapTree; inputs treeA: tree of Curve, treeB: tree of Curve
# ---------- py3: Python ----------
import Rhino.Geometry as rg
from Grasshopper import DataTree
from Grasshopper.Kernel.Data import GH_Path

# Inputs: treeA, treeB (set to Tree Access)
# Output: overlapTree (tree of booleans)

overlapTree = DataTree[bool]()

# Function to check if two curves overlap (more than just intersecting)
def curves_overlap(c1, c2, tol=1e-6):
    events = rg.Intersect.Intersection.CurveCurve(c1, c2, tol, tol)
    if events:
        for event in events:
            if event.IsOverlap:
                return True
    return False

# Go through each shared path
for path in treeA.Paths:
    if not treeB.PathExists(path):
        continue

    curvesA = treeA.Branch(path)
    curvesB = treeB.Branch(path)

    for ca in curvesA:
        found_overlap = False
        for cb in curvesB:
            if curves_overlap(ca, cb):
                found_overlap = True
                break
        overlapTree.Add(found_overlap, path)
# ---------- end py3 ----------
cull_5 = CullPattern(List=explode_2.Segments, CullPattern=py3.overlapTree)
crv_7 = Curve(simplify(cull_5))

# ----
# front doors
crv_8 = Curve(cull_4)

# ----
# interior doors
crv_9 = Curve(cull_3)

# ----
# check if living room has front door
midpt_2 = CurveMiddle(Curve=crv_8)
crv_10 = Curve(trim_2)
# FURNITURE DATASET
incurve = PointInCurve(Point=midpt_2, Curve=crv_10)  # -> Relationship, Point

# ----
# check for door on intersection(s)
join = JoinCurves(Curves=crv_7, Preserve=False)
py3_2 = Python3Script(TreeA=simplify(join), TreeB=crv_9)  # -> out, Overlaps; inputs TreeA: tree of Curve, TreeB: tree of Curve
# ---------- py3_2: Python ----------
import Rhino
import Grasshopper
from Grasshopper import DataTree
from Grasshopper.Kernel.Data import GH_Path

# Prepare output tree
result_tree = DataTree[bool]()

# Loop over TreeB branches
for i in range(TreeB.BranchCount):
    path = TreeB.Path(i)
    curves_b = TreeB.Branch(path)

    # Safely get TreeA branch (may be missing or empty)
    if i < TreeA.BranchCount:
        curves_a = TreeA.Branch(path)
    else:
        curves_a = []

    # If TreeA branch is empty or missing, mark all as False
    if not curves_a or len(curves_a) == 0:
        for _ in curves_b:
            result_tree.Add(False, path)
        continue

    curve_a = curves_a[0]  # still assuming one curve per branch in TreeA

    # Compare curve_a to each curve in TreeB branch
    for curve_b in curves_b:
        events = Rhino.Geometry.Intersect.Intersection.CurveCurve(curve_a, curve_b, 0.001, 0.001)
        overlap_found = False

        if events and events.Count > 0:
            for ev in events:
                if ev.IsOverlap:
                    overlap_found = True
                    break

        result_tree.Add(overlap_found, path)

# Output
Overlaps = result_tree
# ---------- end py3_2 ----------
ma = MassAddition(Input=py3_2.Overlaps)  # -> Result, PartialResults
bool = Boolean(ma.Result)

brep = Brep(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)

# ----
# sofa/table/rug (split)
panel_3 = Panel("sofa-table-rug")
brep_2 = Brep(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)

brep_3 = Brep(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)

brep_4 = Brep(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)

brep_5 = Brep(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)

brep_6 = Brep(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)

brep_7 = Brep(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)

# ----
# dining
panel_4 = Panel("4-seat-dining-table")
brep_8 = Brep(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)

brep_9 = Brep(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)

brep_10 = Brep(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)

brep_11 = Brep(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)

brep_12 = Brep(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)

brep_13 = Brep(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)

# ----
# surfaces
panel_5 = Panel("coffee-table-SQ")
brep_14 = Brep(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)

brep_15 = Brep(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)

brep_16 = Brep(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)

brep_17 = Brep(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)

brep_18 = Brep(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)

brep_19 = Brep(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)

brep_20 = Brep(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)

brep_21 = Brep(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)

brep_22 = Brep(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)

# ----
# kitchens
panel_6 = Panel("row-kitchen")
brep_23 = Brep(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)

# ----
# seating
panel_7 = Panel("desk-chair")
brep_24 = Brep(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)

brep_25 = Brep(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)

brep_26 = Brep(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)

brep_27 = Brep(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)

# ----
# storage
panel_8 = Panel("shelving")
brep_28 = Brep(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)

brep_29 = Brep(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)

# ----
# geometry
entwine = Entwine(
    Branch00=brep_23,
    Branch01=brep_20,
    Branch02=brep_21,
    Branch03=brep_3,
    Branch04=brep_4,
    Branch05=brep_7,
    Branch06=brep_5,
    Branch07=brep_10,
    Branch08=brep_6,
    Branch09=brep_12,
    Branch010=brep_8,
    Branch011=brep_9,
    Branch012=brep_11,
    Branch013=brep_14,
    Branch014=brep_17,
    Branch015=brep_22,
    Branch016=brep_29,
    Branch017=brep_26,
    Branch018=brep_24,
    Branch019=brep_27,
    Branch020=brep_18,
    Branch021=brep_19,
    Branch022=brep_15,
    Branch023=brep_16,
    Branch024=brep_28,
    Branch025=brep_25,
    Branch026=brep_13,
    Branch027=brep_2,
    Branch028=brep,
    FlattenInputs=True)

# ----
# names
entwine_2 = Entwine(
    Branch00=panel_6,
    Branch01="row-kitchen-S",
    Branch02="row-kitchen-L",
    Branch03="kitchen-island-stove",
    Branch04="kitchen-island-sink",
    Branch05="kitchen-island-L",
    Branch06="corner-kitchen-XL",
    Branch07="corner-kitchen-L",
    Branch08="corner-kitchen-L2",
    Branch09="corner-kitchen-S",
    Branch010=panel_4,
    Branch011="4-seat-round-dining-table",
    Branch012="6-seat-dining-table",
    Branch013=panel_5,
    Branch014="coffee-table-S",
    Branch015="coffee-table-L",
    Branch016="desk",
    Branch017="tv-stand",
    Branch018=panel_7,
    Branch019="armchair",
    Branch020="2-seater-sofa",
    Branch021="3-seater-sofa",
    Branch022="corner-sofa-LH",
    Branch023="corner-sofa-RH",
    Branch024=panel_8,
    Branch025="shelving-S",
    Branch026="bookcase-storage",
    Branch027=panel_3,
    Branch028="sofa-table-rug-2",
    FlattenInputs=True)

# ----
# living room crvs
crv_11 = Curve(trim_2)

# ----
# true facade point
join_2 = JoinCurves(Curves=merge, Preserve=False)
explode_3 = Explode(Curve=join_2, Recursive=True)  # -> Segments, Vertices
item_5 = ListItem(List=explode_3.Vertices, Index="1", Wrap=True)

# ----
# furniture to test
midpt_3 = CurveMiddle(Curve=deplan_2.Furniture)
incurve_2 = PointInCurve(Point=midpt_3, Curve=crv_11)  # -> Relationship, Point
cull_6 = CullPattern(List=deplan_2.Furniture, CullPattern=incurve_2.Relationship)
crv_12 = Curve(simplify(cull_6))
runion = RegionUnion(Curves=crv_12)
srf = Surface(simplify(runion))
srf_2 = Surface(runion)
srfsplit = SurfaceSplit(Surface=srf, Curves=crv_12)
srfsplit_2 = SurfaceSplit(Surface=graft(srf_2), Curves=crv_12)
join_3 = BrepJoin(Breps=srfsplit)  # -> Breps, Closed
join_4 = BrepJoin(Breps=srfsplit_2)  # -> Breps, Closed
trim_3 = TrimTree(Tree=join_3.Breps, Depth=1)

# ----
# no front door, no door to circ
not = GateNot(A=incurve.Relationship)
not_2 = GateNot(A=bool)
and = GateAnd(A=not_2, B=not)
dispatch = Dispatch(List=trim_2, DispatchPattern=and)  # -> ListA, ListB
dispatch_2 = Dispatch(List=crv_5, DispatchPattern=and)  # -> ListA, ListB
explode_4 = Explode(Curve=dispatch.ListA, Recursive=True)  # -> simplify(Segments), Vertices
explode_5 = Explode(Curve=dispatch_2.ListA, Recursive=True)  # -> simplify(Segments), Vertices
clean_3 = CleanTree(RemoveNulls=True, RemoveInvalid=True, RemoveEmpty=True, Tree=explode_5.Segments)
py3_3 = Python3Script(treeA=explode_5.Segments, treeB=explode_4.Segments)  # -> out, overlapTree; inputs treeA: tree of Curve, treeB: tree of Curve; same code as py3
cull_7 = CullPattern(List=clean_3, CullPattern=py3_3.overlapTree)
crv_13 = Curve(simplify(cull_7))
midpt_4 = CurveMiddle(Curve=crv_13)

# ----
# intersections
bool_2 = Boolean(py3_2.Overlaps)

# ----
# interiordoors
crv_14 = Curve(crv_9)

# ----
# no front door, door to circ
not_3 = GateNot(A=incurve.Relationship)
and_2 = GateAnd(A=bool, B=not_3)
dispatch_3 = Dispatch(List=crv_14, DispatchPattern=and_2)  # -> ListA, ListB
dispatch_4 = Dispatch(List=bool_2, DispatchPattern=and_2)  # -> ListA, ListB
cull_8 = CullPattern(List=dispatch_3.ListA, CullPattern=dispatch_4.ListA)
midpt_5 = CurveMiddle(Curve=cull_8)

# ----
# front door in livingroom
bool_3 = Boolean(incurve.Relationship)
dispatch_5 = Dispatch(List=midpt_2, DispatchPattern=bool_3)  # -> ListA, ListB

clean_4 = CleanTree(RemoveNulls=True, RemoveInvalid=True, RemoveEmpty=True, Tree=dispatch.ListA)

# ----
# all furni in livingrooms
geo = Geometry(join_3.Breps)

incurve_3 = PointInCurve(Point=midpt_4, Curve=clean_4)  # -> Relationship, Point
equals_2 = Equality(FirstNumber=incurve_3.Relationship, SecondNumber=1)  # -> Equality, Inequality
cull_9 = CullPattern(List=midpt_4, CullPattern=equals_2.Equality)
clean_5 = CleanTree(RemoveNulls=True, RemoveInvalid=True, RemoveEmpty=True, Tree=cull_9)

# ----
# assign weights
panel_9 = Panel("""1
1
1
1
1
1
1
1
1
1
1""")
data = Data(flatten(panel_9))

# ----
# furniture geo
geo_2 = Geometry(geo)

# ----
# assign weights
panel_10 = Panel("""1
1
1
1
1
1
1
1
1
1
1""")
data_2 = Data(flatten(panel_10))

# ----
# living room crvs
crv_15 = Curve(crv_11)

# ----
# get dims
brec = BoundingRectangle(Geometry=crv_15, Plane=PlaneXY(0, 0, 0), Axis=0, Slide=0, Union=True)  # -> simplify(Bounding), DimensionX, DimensionY
explode_6 = Explode(Curve=brec.Bounding, Recursive=True)  # -> Segments, Vertices
len_3 = Length(Curve=explode_6.Segments)
bnd = Bounds(Numbers=len_3)
dedomain = DeconstructDomain(Domain=bnd)  # -> simplify(Start), simplify(End)

# ----
# choose apartment
number_slider = Slider(12, range=0..360)

# ----
# visualise/debug
number_slider_2 = Slider(4, range=0..400)
branch_2 = TreeBranch(Tree=simplify(merge_2), Path=number_slider, MaintainPaths=True)
preview = CustomPreview(Geometry=branch_2, Material=ColourSwatch(SwatchColor=RGB(69, 83, 105)))

# ----
# details
swatch = ColourSwatch(SwatchColor=RGB(96, 115, 145))
branch_3 = TreeBranch(Tree=simplify(deplan_2.ExteriorWalls), Path=number_slider, MaintainPaths=True)
branch_4 = TreeBranch(Tree=simplify(deplan_2.WindowFrames), Path=number_slider, MaintainPaths=True)
preview_2 = CustomPreview(Geometry=branch_3, Material=ColourSwatch(SwatchColor=RGB(125, 125, 125)))
preview_3 = CustomPreview(Geometry=branch_4, Material=ColourSwatch(SwatchColor=RGB(74, 74, 74)))
previewlw = CustomPreviewLineweights(Geometry=branch_3, Shader=swatch, Thickness="2", Absolute=False)

# ----
# livingroom outline
branch_5 = TreeBranch(Tree=crv_15, Path=number_slider, MaintainPaths=True)
previewlw_2 = CustomPreviewLineweights(Geometry=branch_5, Shader=ColourSwatch(SwatchColor=RGB(255, 0, 157)), Thickness="3", Absolute=False)

# ----
# previews
swatch_2 = ColourSwatch(SwatchColor=RGB(166, 232, 255))

# ----
# living room entry point finding
# if living room:
# has no front door AND
# no door between circ and livingroom
# then:
# get circulation intersection line midpoint
# 
# if living room:
# has no front door AND
# door between circ and livingroom
# then:
# get door point
not_4 = GateNot(A=incurve.Relationship)
merge_3 = Merge(Data1=simplify(cull_9), Data2=simplify(midpt_5), Data3=simplify(dispatch_5.ListA))

# ----
# filter
and_3 = GateAnd(A=bool, B=not_4)
dispatch_6 = Dispatch(List=trim_2, DispatchPattern=and_3)  # -> ListA, ListB
dispatch_7 = Dispatch(List=crv_5, DispatchPattern=and_3)  # -> ListA, ListB
runion_2 = RegionUnion(Curves=[dispatch_6.ListB, dispatch_7.ListB])
merge_4 = Merge(Data1=simplify(runion_2), Data2=simplify(dispatch_6.ListA))

# ----
# living rooms to test
crv_16 = Curve(merge_4)

area = Area(Geometry=crv_16)  # -> Area, Centroid
sort = SortList(Keys=area.Area, ValuesA=crv_16)  # -> Keys, ValuesA
item_6 = ListItem(List=sort.ValuesA, Index="-1", Wrap=True)

# ----
# entry points
pt = Point(merge_3)

branch_6 = TreeBranch(Tree=pt, Path=number_slider, MaintainPaths=True)
panel_11 = Panel("entry door")

# ----
# creating lookup table
geo_3 = Geometry(entwine)
edges = BrepEdges(Brep=geo_3)  # -> Naked, Interior, NonManifold
brec_2 = BoundingRectangle(Geometry=geo_3, Plane=PlaneXY(0, 0, 0), Axis=0, Slide=0, Union=True)  # -> Bounding, DimensionX, DimensionY
debrep_2 = DeconstructBrep(Brep=geo_3)  # -> Faces, Edges, Vertices

runion_3 = RegionUnion(Curves=geo_3)
explode_7 = Explode(Curve=runion_3, Recursive=True)  # -> Segments, Vertices
lng_2 = ListLength(List=explode_7.Segments)

panel_12 = Panel("region-crvs")
num = Number(simplify(flatten(lng_2)))

bnd_2 = Bounds(Numbers=num)
remap = RemapNumbers(Value=num, Source=bnd_2, Target=Domain(0, 1))  # -> Mapped, Clipped

area_2 = Area(Geometry=geo_3)  # -> Area, Centroid

num_2 = Number(simplify(flatten(area_2.Area)))
panel_13 = Panel("area")

bnd_3 = Bounds(Numbers=num_2)
remap_2 = RemapNumbers(Value=num_2, Source=bnd_3, Target=Domain(0, 1))  # -> Mapped, Clipped

crvkinky = IsCurveKinky(Curve=geo_3)  # -> Kinked, Amount, Lengths

num_3 = Number(simplify(flatten(crvkinky.Amount)))
panel_14 = Panel("kink-count")

bnd_4 = Bounds(Numbers=num_3)
remap_3 = RemapNumbers(Value=num_3, Source=bnd_4, Target=Domain(0, 1))  # -> Mapped, Clipped

join_5 = JoinCurves(Curves=debrep_2.Edges, Preserve=False)
cls = Closed(Curve=join_5)  # -> Closed, Periodic
num_4 = Number(cls.Closed)
ma_2 = MassAddition(Input=num_4)  # -> simplify(Result), PartialResults

panel_15 = Panel("closed-crvs")
num_5 = Number(flatten(ma_2.Result))

bnd_5 = Bounds(Numbers=num_5)
remap_4 = RemapNumbers(Value=num_5, Source=bnd_5, Target=Domain(0, 1))  # -> Mapped, Clipped

min = Minimum(A=brec_2.DimensionX, B=brec_2.DimensionY)

num_6 = Number(simplify(flatten(min)))
panel_16 = Panel("bb-short-dim")

bnd_6 = Bounds(Numbers=num_6)
remap_5 = RemapNumbers(Value=num_6, Source=bnd_6, Target=Domain(0, 1))  # -> Mapped, Clipped

max = Maximum(A=brec_2.DimensionX, B=brec_2.DimensionY)

num_7 = Number(simplify(flatten(max)))
panel_17 = Panel("bb-long-dim")

bnd_7 = Bounds(Numbers=num_7)
remap_6 = RemapNumbers(Value=num_7, Source=bnd_7, Target=Domain(0, 1))  # -> Mapped, Clipped

# ----
# get the corner facade point (between windows)
debrep_3 = DeconstructBrep(Brep=trim_2)  # -> Faces, Edges, Vertices

# ----
# livingroom points
pt_2 = Point(debrep_3.Vertices)

cp = ClosestPoint(Point=item_5, Cloud=pt_2)  # -> ClosestPoint, CPIndex, Distance

# ----
# point between facades
pt_3 = Point(simplify(cp.ClosestPoint))

panel_18 = Panel("facade corner")
branch_7 = TreeBranch(Tree=pt_3, Path=number_slider, MaintainPaths=True)

lng_3 = ListLength(List=edges.Naked)

panel_19 = Panel("naked-edge-count")
num_8 = Number(simplify(flatten(lng_3)))

bnd_8 = Bounds(Numbers=num_8)
remap_7 = RemapNumbers(Value=num_8, Source=bnd_8, Target=Domain(0, 1))  # -> Mapped, Clipped

lng_4 = ListLength(List=edges.Interior)

panel_20 = Panel("interior-edge-count")
num_9 = Number(simplify(flatten(lng_4)))

bnd_9 = Bounds(Numbers=num_9)
remap_8 = RemapNumbers(Value=num_9, Source=bnd_9, Target=Domain(0, 1))  # -> Mapped, Clipped

lng_5 = ListLength(List=debrep_2.Edges)

num_10 = Number(simplify(flatten(lng_5)))
panel_21 = Panel("edge-count")

bnd_10 = Bounds(Numbers=num_10)
remap_9 = RemapNumbers(Value=num_10, Source=bnd_10, Target=Domain(0, 1))  # -> Mapped, Clipped

lng_6 = ListLength(List=debrep_2.Faces)

num_11 = Number(simplify(flatten(lng_6)))
panel_22 = Panel("face-count")

bnd_11 = Bounds(Numbers=num_11)
remap_10 = RemapNumbers(Value=num_11, Source=bnd_11, Target=Domain(0, 1))  # -> Mapped, Clipped

debrep_4 = DeconstructBrep(Brep=deplan_2.WindowFrames)  # -> Faces, Edges, Vertices
fline = FitLine(Points=debrep_4.Vertices)

# ----
# windowlines
crv_17 = Curve(fline)

trim_4 = TrimTree(Tree=crv_17, Depth=1)
midpt_6 = CurveMiddle(Curve=trim_4)

# ----
# get window points
incurve_4 = PointInCurve(Point=midpt_6, Curve=crv_15)  # -> Relationship, Point
dispatch_8 = Dispatch(List=trim_4, DispatchPattern=incurve_4.Relationship)  # -> ListA, ListB

# ----
# window crvs
crv_18 = Curve(simplify(dispatch_8.ListA))

midpt_7 = CurveMiddle(Curve=crv_18)
panel_23 = Panel("window centerpoints")
branch_8 = TreeBranch(Tree=midpt_7, Path=number_slider, MaintainPaths=True)

division = Division(A=num_7, B=num_6)

panel_24 = Panel("aspect-ratio")
num_12 = Number(division)

bnd_12 = Bounds(Numbers=num_12)
remap_11 = RemapNumbers(Value=num_12, Source=bnd_12, Target=Domain(0, 1))  # -> Mapped, Clipped

entwine_3 = Entwine(
    Branch00=remap_10.Mapped,
    Branch01=remap_9.Mapped,
    Branch02=remap_4.Mapped,
    Branch03=remap_2.Mapped,
    Branch04=remap_5.Mapped,
    Branch05=remap_6.Mapped,
    Branch06=remap_11.Mapped,
    Branch07=remap.Mapped,
    Branch08=remap_7.Mapped,
    Branch09=remap_8.Mapped,
    Branch010=remap_3.Mapped,
    FlattenInputs=True)
flip = FlipMatrix(Data=entwine_3)

# ----
# classification testing
geo_4 = Geometry(geo)
brec_3 = BoundingRectangle(Geometry=graft(geo_4), Plane=PlaneXY(0, 0, 0), Axis=0, Slide=0, Union=True)  # -> Bounding, DimensionX, DimensionY
debrep_5 = DeconstructBrep(Brep=geo_4)  # -> Faces, Edges, Vertices
edges_2 = BrepEdges(Brep=geo_4)  # -> Naked, Interior, NonManifold

area_3 = Area(Geometry=geo_4)  # -> Area, Centroid

num_13 = Number(simplify(graft(area_3.Area)))

remap_12 = RemapNumbers(Value=num_13, Source=bnd_3, Target=Domain(0, 1))  # -> Mapped, Clipped

runion_4 = RegionUnion(Curves=geo_4)
explode_8 = Explode(Curve=runion_4, Recursive=True)  # -> Segments, Vertices
lng_7 = ListLength(List=explode_8.Segments)

num_14 = Number(simplify(lng_7))

remap_13 = RemapNumbers(Value=num_14, Source=bnd_2, Target=Domain(0, 1))  # -> Mapped, Clipped

crvkinky_2 = IsCurveKinky(Curve=geo_4)  # -> Kinked, graft(Amount), Lengths

num_15 = Number(simplify(crvkinky_2.Amount))

remap_14 = RemapNumbers(Value=num_15, Source=bnd_4, Target=Domain(0, 1))  # -> Mapped, Clipped

min_2 = Minimum(A=brec_3.DimensionX, B=brec_3.DimensionY)

num_16 = Number(simplify(min_2))

remap_15 = RemapNumbers(Value=num_16, Source=bnd_6, Target=Domain(0, 1))  # -> Mapped, Clipped

max_2 = Maximum(A=brec_3.DimensionX, B=brec_3.DimensionY)

num_17 = Number(simplify(max_2))

remap_16 = RemapNumbers(Value=num_17, Source=bnd_7, Target=Domain(0, 1))  # -> Mapped, Clipped

lng_8 = ListLength(List=debrep_5.Edges)

num_18 = Number(simplify(lng_8))

remap_17 = RemapNumbers(Value=num_18, Source=bnd_10, Target=Domain(0, 1))  # -> Mapped, Clipped

join_6 = JoinCurves(Curves=debrep_5.Edges, Preserve=False)
cls_2 = Closed(Curve=join_6)  # -> Closed, Periodic
num_19 = Number(cls_2.Closed)
ma_3 = MassAddition(Input=num_19)  # -> simplify(Result), PartialResults

num_20 = Number(ma_3.Result)

remap_18 = RemapNumbers(Value=num_20, Source=bnd_5, Target=Domain(0, 1))  # -> Mapped, Clipped

lng_9 = ListLength(List=debrep_5.Faces)

num_21 = Number(simplify(lng_9))

remap_19 = RemapNumbers(Value=num_21, Source=bnd_11, Target=Domain(0, 1))  # -> Mapped, Clipped

lng_10 = ListLength(List=edges_2.Naked)

num_22 = Number(simplify(lng_10))

remap_20 = RemapNumbers(Value=num_22, Source=bnd_8, Target=Domain(0, 1))  # -> Mapped, Clipped

lng_11 = ListLength(List=edges_2.Interior)

num_23 = Number(simplify(lng_11))

remap_21 = RemapNumbers(Value=num_23, Source=bnd_9, Target=Domain(0, 1))  # -> Mapped, Clipped

division_2 = Division(A=num_17, B=num_16)

num_24 = Number(division_2)

remap_22 = RemapNumbers(Value=num_24, Source=bnd_12, Target=Domain(0, 1))  # -> Mapped, Clipped

merge_5 = Merge(
    Data1=simplify(remap_19.Mapped),
    Data2=simplify(remap_17.Mapped),
    Data3=simplify(remap_18.Mapped),
    Data4=simplify(remap_12.Mapped),
    Data5=simplify(remap_15.Mapped),
    Data6=simplify(remap_16.Mapped),
    Data7=simplify(remap_22.Mapped),
    Data8=simplify(remap_13.Mapped),
    Data9=simplify(remap_20.Mapped),
    Data10=simplify(remap_21.Mapped),
    Data11=simplify(remap_14.Mapped))

panel_36 = Panel(division_2)

# ----
# lookup 1-NN: stage1
py3_4 = Python3Script(X_ref=flip, y_ref=entwine_2, x=merge_5, weights=data)  # -> out, predictions, distances_out; inputs X_ref: tree, y_ref: tree, x: tree, weights: list
# ---------- py3_4: Python ----------
import math
from Grasshopper import DataTree
from Grasshopper.Kernel.Data import GH_Path

# Output trees
predictions = DataTree[str]()
distances_out = DataTree[float]()

# Convert reference vectors and labels to flat lists
ref_vectors = [list(X_ref.Branch(path)) for path in X_ref.Paths]
ref_labels = [list(y_ref.Branch(path))[0] for path in y_ref.Paths]

# Flatten and convert weights
if isinstance(weights[0], list):
    weights = weights[0]
weights = [float(w) for w in weights]

# Length check
expected_len = len(ref_vectors[0])
if len(weights) != expected_len:
    raise ValueError(f"Weight list must have {expected_len} values (got {len(weights)}).")

# Loop through test inputs
for path in x.Paths:
    input_vector = list(x.Branch(path))
    gh_path = GH_Path(path)

    if len(input_vector) == expected_len:
        # Compute weighted Euclidean distances
        distances = [
            math.sqrt(sum(w * (iv - rv) ** 2 for iv, rv, w in zip(input_vector, ref_vec, weights)))
            for ref_vec in ref_vectors
        ]
        min_index = distances.index(min(distances))
        label = ref_labels[min_index]
        min_dist = distances[min_index]
    else:
        label = "Invalid input vector"
        min_dist = -1.0

    predictions.Add(label, gh_path)
    distances_out.Add(min_dist, gh_path)
# ---------- end py3_4 ----------

# ----
# splitting up sofa-table-rug furniture
panel_37 = Panel("sofa-table-rug")
tmatch_2 = MatchText(Text=py3_4.predictions, RegEx=panel_37, Case=True)
dispatch_9 = Dispatch(List=py3_4.predictions, DispatchPattern=tmatch_2)  # -> ListA, ListB
dispatch_10 = Dispatch(List=geo_2, DispatchPattern=tmatch_2)  # -> ListA, ListB
geo_5 = Geometry(dispatch_10.ListA)
clean_6 = CleanTree(RemoveNulls=True, RemoveInvalid=True, RemoveEmpty=True, Tree=geo_5)
debrep_6 = DeconstructBrep(Brep=clean_6)  # -> Faces, Edges, Vertices
area_4 = Area(Geometry=debrep_6.Faces)  # -> Area, Centroid
sort_2 = SortList(Keys=area_4.Area, ValuesA=debrep_6.Faces)  # -> Keys, ValuesA
lng_12 = ListLength(List=sort_2.ValuesA)
split = SplitList(List=sort_2.ValuesA, Index=expr("x-1", lng_12))  # -> ListA, ListB
runion_5 = RegionUnion(Curves=split.ListA)
srf_3 = Surface(simplify(runion_5))
srfsplit_3 = SurfaceSplit(Surface=srf_3, Curves=split.ListA)
join_7 = BrepJoin(Breps=srfsplit_3)  # -> simplify(Breps), Closed

# ----
# rerun classification for sofa-table-rug furniture
geo_6 = Geometry(join_7.Breps)
brec_4 = BoundingRectangle(Geometry=graft(geo_6), Plane=PlaneXY(0, 0, 0), Axis=0, Slide=0, Union=True)  # -> Bounding, DimensionX, DimensionY
debrep_7 = DeconstructBrep(Brep=geo_6)  # -> Faces, Edges, Vertices
edges_3 = BrepEdges(Brep=geo_6)  # -> Naked, Interior, NonManifold

area_5 = Area(Geometry=geo_6)  # -> Area, Centroid

num_25 = Number(simplify(graft(area_5.Area)))

remap_23 = RemapNumbers(Value=num_25, Source=bnd_3, Target=Domain(0, 1))  # -> Mapped, Clipped

runion_6 = RegionUnion(Curves=geo_6)
explode_9 = Explode(Curve=runion_6, Recursive=True)  # -> Segments, Vertices
lng_13 = ListLength(List=explode_9.Segments)

num_26 = Number(simplify(lng_13))

remap_24 = RemapNumbers(Value=num_26, Source=bnd_2, Target=Domain(0, 1))  # -> Mapped, Clipped

crvkinky_3 = IsCurveKinky(Curve=geo_6)  # -> Kinked, graft(Amount), Lengths

num_27 = Number(simplify(crvkinky_3.Amount))

remap_25 = RemapNumbers(Value=num_27, Source=bnd_4, Target=Domain(0, 1))  # -> Mapped, Clipped

min_3 = Minimum(A=brec_4.DimensionX, B=brec_4.DimensionY)

num_28 = Number(simplify(min_3))

remap_26 = RemapNumbers(Value=num_28, Source=bnd_6, Target=Domain(0, 1))  # -> Mapped, Clipped

max_3 = Maximum(A=brec_4.DimensionX, B=brec_4.DimensionY)

num_29 = Number(simplify(max_3))

remap_27 = RemapNumbers(Value=num_29, Source=bnd_7, Target=Domain(0, 1))  # -> Mapped, Clipped

lng_14 = ListLength(List=debrep_7.Edges)

num_30 = Number(simplify(lng_14))

remap_28 = RemapNumbers(Value=num_30, Source=bnd_10, Target=Domain(0, 1))  # -> Mapped, Clipped

join_8 = JoinCurves(Curves=debrep_7.Edges, Preserve=False)
cls_3 = Closed(Curve=join_8)  # -> Closed, Periodic
num_31 = Number(cls_3.Closed)
ma_4 = MassAddition(Input=num_31)  # -> simplify(Result), PartialResults

num_32 = Number(ma_4.Result)

remap_29 = RemapNumbers(Value=num_32, Source=bnd_5, Target=Domain(0, 1))  # -> Mapped, Clipped

lng_15 = ListLength(List=debrep_7.Faces)

num_33 = Number(simplify(lng_15))

remap_30 = RemapNumbers(Value=num_33, Source=bnd_11, Target=Domain(0, 1))  # -> Mapped, Clipped

lng_16 = ListLength(List=edges_3.Naked)

num_34 = Number(simplify(lng_16))

remap_31 = RemapNumbers(Value=num_34, Source=bnd_8, Target=Domain(0, 1))  # -> Mapped, Clipped

lng_17 = ListLength(List=edges_3.Interior)

num_35 = Number(simplify(lng_17))

remap_32 = RemapNumbers(Value=num_35, Source=bnd_9, Target=Domain(0, 1))  # -> Mapped, Clipped

division_3 = Division(A=num_29, B=num_28)

num_36 = Number(division_3)

remap_33 = RemapNumbers(Value=num_36, Source=bnd_12, Target=Domain(0, 1))  # -> Mapped, Clipped

merge_6 = Merge(
    Data1=simplify(remap_30.Mapped),
    Data2=simplify(remap_28.Mapped),
    Data3=simplify(remap_29.Mapped),
    Data4=simplify(remap_23.Mapped),
    Data5=simplify(remap_26.Mapped),
    Data6=simplify(remap_27.Mapped),
    Data7=simplify(remap_33.Mapped),
    Data8=simplify(remap_24.Mapped),
    Data9=simplify(remap_31.Mapped),
    Data10=simplify(remap_32.Mapped),
    Data11=simplify(remap_25.Mapped))

# ----
# lookup 1-NN: stage2
# append new furniture
py3_5 = Python3Script(X_ref=flip, y_ref=entwine_2, x=merge_6, weights=data_2)  # -> out, predictions, distances_out; inputs X_ref: tree, y_ref: tree, x: tree, weights: list; same code as py3_4
tstat = TreeStatistics(Tree=join_7.Breps)  # -> Paths, Length, Count
tstat_2 = TreeStatistics(Tree=py3_5.predictions)  # -> Paths, Length, Count
repeat = RepeatData(Data="1", Length=tstat.Count)  # -> graft(Data)
repeat_2 = RepeatData(Data="1", Length=tstat_2.Count)  # -> graft(Data)
match = MatchTree(Tree=repeat, Guide=join_7.Breps)
match_2 = MatchTree(Tree=repeat_2, Guide=py3_5.predictions)
py3_6 = Python3Script(x=py3_5.predictions, depths=match_2)  # -> out, a; inputs x: tree, depths: tree
# ---------- py3_6: Python ----------
from Grasshopper import DataTree
from Grasshopper.Kernel.Data import GH_Path

# Initialize output tree
new_tree = DataTree[object]()

# Normalize depths input to a flat list of integers
flat_depths = []
try:
    for branch in depths.Branches:
        flat_depths.append(int(branch[0]))
except:
    flat_depths = [int(d) for d in depths]

# Loop through each branch in input tree
for i in range(x.BranchCount):
    original_path = x.Path(i)
    items = x.Branch(i)

    # Skip if depth is missing
    if i >= len(flat_depths):
        continue

    trim_depth = flat_depths[i]

    # Extract full path as list of integers
    indices = [original_path[j] for j in range(original_path.Length)]

    # Trim path to desired depth
    trimmed_indices = indices[:trim_depth]
    trimmed_path = GH_Path(*trimmed_indices)

    # Append items to new tree under the trimmed path
    for item in items:
        new_tree.Add(item, trimmed_path)

# Output
a = new_tree
# ---------- end py3_6 ----------
py3_7 = Python3Script(x=join_7.Breps, depths=match)  # -> out, a; inputs x: tree, depths: tree; same code as py3_6
panel_49 = Panel(py3_7.a)
panel_50 = Panel(py3_6.a)
trim_5 = TrimTree(Tree=dispatch_9.ListB, Depth=1)

# ----
# new furniture list
trim_6 = TrimTree(Tree=dispatch_10.ListB, Depth=1)
merge_7 = Merge(Data1=trim_6, Data2=py3_7.a)
geo_7 = Geometry(merge_7)

# ----
# new predictions
merge_8 = Merge(Data1=trim_5, Data2=py3_6.a)
data_3 = Data(merge_8)

# ----
# get kitchen (but not islands)
panel_51 = Panel("island")
tmatch_3 = MatchText(Text=data_3, RegEx="kitchen", Case=True)
tmatch_4 = MatchText(Text=data_3, RegEx=panel_51, Case=True)
not_5 = GateNot(A=tmatch_4)
and_4 = GateAnd(A=tmatch_3, B=not_5)
dispatch_11 = Dispatch(List=geo_7, DispatchPattern=and_4)  # -> ListA, ListB
geo_8 = Geometry(dispatch_11.ListA)

# ----
# get kitchen wall host
explode_10 = Explode(Curve=crv_15, Recursive=True)  # -> Segments, Vertices
area_6 = Area(Geometry=geo_8)  # -> Area, Centroid
crv_cp = CurveClosestPoint(Point=area_6.Centroid, Curve=explode_10.Segments)  # -> Point, Parameter, Distance
sort_3 = SortList(Keys=crv_cp.Distance, ValuesA=explode_10.Segments)  # -> Keys, ValuesA
item_7 = ListItem(List=sort_3.ValuesA, Index=0, Wrap=True)  # -> simplify(Item)
pull = PullPoint(Point=area_6.Centroid, Geometry=item_7, ClosestOnly=True)  # -> ClosestPoint, Distance, Index

# ----
# kitchen wall host point
pt_4 = Point(pull.ClosestPoint)

# ----
# cull apartments that don't work
lng_18 = ListLength(List=pt)
cull_10 = CullPattern(List=pt_3, CullPattern=lng_18)
cull_11 = CullPattern(List=pt_4, CullPattern=lng_18)
cull_12 = CullPattern(List=pt, CullPattern=lng_18)
cull_13 = CullPattern(List=crv_18, CullPattern=lng_18)
clean_7 = CleanTree(RemoveNulls=True, RemoveInvalid=True, RemoveEmpty=True, Tree=cull_12)
clean_8 = CleanTree(RemoveNulls=True, RemoveInvalid=True, RemoveEmpty=True, Tree=cull_13)
clean_9 = CleanTree(RemoveNulls=True, RemoveInvalid=True, RemoveEmpty=True, Tree=cull_10)
clean_10 = CleanTree(RemoveNulls=True, RemoveInvalid=True, RemoveEmpty=True, Tree=cull_11)

# ----
# final furniture names
cull_14 = CullPattern(List=data_3, CullPattern=lng_18)
clean_11 = CleanTree(RemoveNulls=True, RemoveInvalid=True, RemoveEmpty=True, Tree=cull_14)
data_4 = Data(clean_11)

# ----
# final furniture
cull_15 = CullPattern(List=geo_7, CullPattern=lng_18)
clean_12 = CleanTree(RemoveNulls=True, RemoveInvalid=True, RemoveEmpty=True, Tree=cull_15)
geo_9 = Geometry(clean_12)

area_7 = Area(Geometry=clean_12)  # -> Area, Centroid

# ----
# final furniture points
pt_5 = Point(area_7.Centroid)

# ----
# build a networkX graph
merge_9 = Merge(Data1=clean_7, Data2=clean_9, Data3=clean_10, Data4=clean_8)
brec_5 = BoundingRectangle(Geometry=geo_9, Plane=PlaneXY(0, 0, 0), Axis=0, Slide=0, Union=False)  # -> simplify(Bounding), DimensionX, DimensionY

# ----
# element names
panel_52 = Panel("kitchen-wall")
lng_19 = ListLength(List=clean_8)
lng_20 = ListLength(List=clean_10)
lng_21 = ListLength(List=clean_9)
lng_22 = ListLength(List=clean_7)
series = Series(Start=0, Step=1, Count=lng_19)
repeat_3 = RepeatData(Data="door", Length=lng_22)  # -> simplify(Data)
repeat_4 = RepeatData(Data="facade-corner", Length=lng_21)  # -> simplify(Data)
repeat_5 = RepeatData(Data=panel_52, Length=lng_20)  # -> simplify(Data)
concat = Concatenate(FragmentA="window", FragmentB=series)  # -> simplify(Result)
merge_10 = Merge(Data1=repeat_3, Data2=repeat_4, Data3=repeat_5, Data4=concat)

# ----
# node types
panel_53 = Panel("reference")
lng_23 = ListLength(List=merge_9)
lng_24 = ListLength(List=data_4)
repeat_6 = RepeatData(Data="furniture", Length=lng_24)  # -> simplify(Data)
repeat_7 = RepeatData(Data=panel_53, Length=lng_23)  # -> simplify(Data)
merge_11 = Merge(Data1=repeat_6, Data2=repeat_7)

# ----
# node geometries
merge_12 = Merge(Data1=pt_5, Data2=merge_9)

# ----
# node names
merge_13 = Merge(Data1=data_4, Data2=merge_10)

# ----
# build networkX
panel_54 = Panel("D:\Users\angel\OneDrive\Desktop\apartmentsv2")
showlabels = BooleanToggle(True)
json_write = LBFalseStartToggle(False)
py3_8 = Python3Script(
    bounding_rectangles=brec.Bounding,
    b_x=simplify(brec.DimensionX),
    b_y=simplify(brec.DimensionY),
    node_types=merge_11,
    node_names=merge_13,
    node_geometries=merge_12,
    furniture_bounding_rectangles=brec_5.Bounding,
    show_labels=showlabels,
    write_json=json_write,
    folder=panel_54)  # -> out, node_points, node_labels, normalized_node_points; inputs bounding_rectangles: tree of Curve, b_x: tree, b_y: tree, node_types: tree of String, node_names: tree of String, node_geometries: tree of GeometryBase, furniture_bounding_rectangles: tree of Curve, show_labels: Boolean
# ---------- py3_8: Python ----------
import networkx as nx
import Rhino.Geometry as rg
from Grasshopper import DataTree
from Grasshopper.Kernel.Data import GH_Path
import os
import json

# Inputs (from Grasshopper):
# node_types, node_names, node_geometries: DataTree
# furniture_bounding_rectangles: DataTree
# b_x, b_y: DataTree
# bounding_rectangles: DataTree
# write_json: bool
# folder: str

# Outputs
node_points = DataTree[object]()
normalized_node_points = DataTree[object]()
furniture_names = DataTree[str]()
node_labels = DataTree[str]()

# --- Helpers ---

def get_position(geom):
    if isinstance(geom, rg.Point3d):
        return geom
    elif isinstance(geom, rg.Curve):
        try:
            t = geom.Domain.ParameterAt(0.5)
            return geom.PointAt(t)
        except:
            return rg.Point3d(0, 0, 0)
    elif hasattr(geom, "GetBoundingBox"):
        try:
            return geom.GetBoundingBox(True).Center
        except:
            return rg.Point3d(0, 0, 0)
    return rg.Point3d(0, 0, 0)

def normalize_xy_from_bounds(pt, origin_x, origin_y, b_x, b_y):
    if b_x == 0 or b_y == 0:
        return (0.0, 0.0)
    local_x = pt.X - origin_x
    local_y = pt.Y - origin_y
    norm_x = local_x / b_x
    norm_y = local_y / b_y
    return (
        max(0.0, min(norm_x, 1.0)),
        max(0.0, min(norm_y, 1.0))
    )

# --- Main Loop ---

apartment_layouts = []

for path in node_types.Paths:
    i = path.Indices[0]

    types = list(node_types.Branch(path))
    names = list(node_names.Branch(path))
    geoms = list(node_geometries.Branch(path))
    rects = list(furniture_bounding_rectangles.Branch(path))

    if len(types) != len(names) or len(names) != len(geoms):
        print(f"⚠️ Skipping apartment {i}: mismatched input lengths")
        continue

    try:
        b_x_val = float(list(b_x.Branch(path))[0])
        b_y_val = float(list(b_y.Branch(path))[0])
        apt_rect = bounding_rectangles.Branch(path)[0]
        bbox = apt_rect.GetBoundingBox(True)
        origin_x = bbox.Min.X
        origin_y = bbox.Min.Y
    except:
        print(f"⚠️ Skipping apartment {i}: missing b_x/b_y or bounding rectangle")
        continue

    # Copy node names to output
    for name in names:
        node_labels.Add(name, path)

    G = nx.Graph()
    layout = {
        "apartment_id": i,
        "b_x": b_x_val,
        "b_y": b_y_val,
        "furniture": []
    }

    for j, (typ, name, geom) in enumerate(zip(types, names, geoms)):
        typ_clean = typ.strip().lower()
        node_id = f"{typ_clean}_{i}_{j}"

        pos = get_position(geom)
        norm_xy = normalize_xy_from_bounds(pos, origin_x, origin_y, b_x_val, b_y_val)

        G.add_node(
            node_id,
            type=typ_clean,
            label=name,
            position=(pos.X, pos.Y, pos.Z),
            normalized_position=(norm_xy[0], norm_xy[1]),
            apartment=i
        )

        node_points.Add(pos, path)
        normalized_node_points.Add(rg.Point3d(norm_xy[0], norm_xy[1], 0), path)

        if typ_clean == "furniture":
            furniture_names.Add(name, path)

            # Get bounding box from input rectangle
            try:
                rect_geom = rects[j]
                bbox = rect_geom.GetBoundingBox(True)
                min_pt = bbox.Min
                max_pt = bbox.Max

                norm_min = normalize_xy_from_bounds(min_pt, origin_x, origin_y, b_x_val, b_y_val)
                norm_max = normalize_xy_from_bounds(max_pt, origin_x, origin_y, b_x_val, b_y_val)

                normalized_bbox = [
                    [round(norm_min[0], 4), round(norm_min[1], 4)],
                    [round(norm_max[0], 4), round(norm_max[1], 4)]
                ]
            except:
                normalized_bbox = [[0.0, 0.0], [0.0, 0.0]]

            layout["furniture"].append({
                "furniture_id": node_id,
                "furniture_name": name,
                "type": typ_clean,
                "normalized_position": [round(norm_xy[0], 4), round(norm_xy[1], 4)],
                "normalized_bbox": normalized_bbox
            })

    apartment_layouts.append(layout)

# --- Write JSON ---
if write_json:
    try:
        os.makedirs(folder, exist_ok=True)
        json_path = os.path.join(folder, "all_apartment_layouts.json")
        with open(json_path, "w") as jf:
            json.dump(apartment_layouts, jf, indent=2)
        print(f"✔ JSON exported to: {json_path}")
    except Exception as e:
        print(f"❌ Failed to write JSON: {e}")
# ---------- end py3_8 ----------

panel_55 = Panel("kitchen wall centerpoint")
branch_9 = TreeBranch(Tree=pt_4, Path=number_slider, MaintainPaths=True)

branch_10 = TreeBranch(Tree=geo_7, Path=number_slider, MaintainPaths=True)
panel_56 = Panel("furni")
preview_4 = CustomPreview(Geometry=branch_10, Material=ColourSwatch(SwatchColor=RGB(43, 67, 102)))

# ----
# node names
branch_11 = TreeBranch(Tree=py3_8.node_points, Path=number_slider, MaintainPaths=True)
branch_12 = TreeBranch(Tree=py3_8.node_labels, Path=number_slider, MaintainPaths=True)
tag = TextTag3D(Location=branch_11, Text=branch_12, Size="0.12", Colour=ColourSwatch(SwatchColor=RGB(255, 255, 255)), Justification=8)

# ----
# furni points
branch_13 = TreeBranch(Tree=pt_5, Path=number_slider, MaintainPaths=True)
dots = DotDisplay(Point=branch_13, Colour=ColourSwatch(SwatchColor=RGB(255, 0, 157)), Size="0.1")

# ----
# reference nodes
swatch_3 = ColourSwatch(SwatchColor=RGB(255, 0, 0))
swatch_4 = ColourSwatch(SwatchColor=RGB(0, 255, 242))
dots_2 = DotDisplay(Point=[branch_7, branch_6, branch_9], Colour=swatch_2, Size="0.1")
dots_3 = DotDisplay(Point=branch_8, Colour=swatch_2, Size="0.1")
