# Grasshopper definition prompt.gh (Grasshopper 1.0.8)
# plug-ins: RhinoCodePluginGH

# ----
# Prompts
# UI
# At 0:00 I’m sleeping in bed. I continue sleeping until 6:00.
# At 6:00 I scroll on my phone while still in bed.
# At 7:00 I take a shower.
# At 8:00 I sit on the sofa, have a coffee, and listen to music.
# At 9:00 I watch Netflix and eat a snack on the sofa.
# At 10:00 I move to my desk and work on my laptop.
# At 11:00 I continue studying at the desk.
# At 12:00 I cook and eat lunch .
# At 13:00 I relax with a book in the armchair.
# At 14:00 I take a nap in bed.
# At 15:00 I do yoga on a yoga mat.
# At 16:00 I return to the desk to write notes.
# At 17:00 I play video games while sitting on the sofa.
# At 18:00 I chat with friends online, still on the sofa.
# At 19:00 I have dinner at the dining table.
# At 20:00 I read a magazine in the armchair.
# At 21:00 I rest and listen to music on the sofa.
# At 22:00 I scroll on my phone while lying in bed.
# At 23:00 I fall asleep.
# Promt Example 2: I usually wake up around 6am and scroll on my phone for a bit. By 7am, I shower and have a coffee while listening to music. Around 8am, I work on my laptop and study until 12pm. At noon, I cook lunch and eat a snack while watching Netflix.
# 
# After lunch, I take a short nap around 1pm and then relax with a book until 2pm. Around 3pm, I do some yoga and then continue working on my laptop until 5pm. From 6pm to 7pm I play video games and chat with friends online. At 8pm, I read a magazine or the newspaper.
# 
# Around 9pm I rest on the sofa and listen to music again. By 10pm, I scroll on my phone and slowly get ready for bed. I’m usually sleeping from 11pm to 6am.
# Promt Example 2: I sleep from 0:00 to 6:00.
# At 6:00 I scroll on my phone.
# At 7:00 I take a shower.
# At 8:00 I have a coffee.
# At 9:00 I relax and read a magazine.
# At 10:00 I watch Netflix.
# At 11:00 I work on my laptop.
# At 12:00 I cook lunch and eat at the dining table.
# At 13:00 I read a book.
# At 14:00 I nap.
# At 15:00 I do yoga.
# At 16:00 I write notes.
# At 17:00 I play video games.
# At 18:00 I chat with friends.
# At 19:00 I have dinner at the dining table.
# At 20:00 I read the newspaper.
# At 21:00 I rest.
# At 22:00 I scroll on my phone again.
# At 23:00 I sleep.
toggle = BooleanToggle(False)
py3 = Python3Script(run=toggle)  # -> out, prompt
# ---------- py3: Python ----------
import requests
import json

# Initialize the output variable
message = "The user preferences have not been generated yet"
print(message)

# Define the URL for the Flask server endpoint
url = 'http://127.0.0.1:5000/send_to_grasshopper'

# Get the response from the Flask server
message = requests.get(url)
response_data = message.json()  # Convert JSON string to a dictionary

# Extract the relevant part
received_message = response_data.get("response", "")  # Get the value of "response"
prompt = received_message.split(": ")[-1]  # Extract everything after ": "

# Print the output in the Grasshopper Python component
print(prompt)
# ---------- end py3 ----------
panel = Panel(py3.prompt)

# ----
# LLM CALLS
# METRATES
# ACTIVITIES
# FURNITURE
boolean_toggle = BooleanToggle(True)
python_3_script = Python3Script(prompt=py3.prompt, run=boolean_toggle)  # -> out, activities_json, flatten(hourly_mets), flatten(hourly_acts), hourly_furn
# ---------- python_3_script: Python ----------
import requests
import json

# Initialize outputs
activities_json = []
hourly_mets = []
hourly_acts = []
hourly_furn = []

if run:
    try:
        # Set up request
        url = "http://127.0.0.1:5000/extract_activities"
        headers = {"Content-Type": "application/json"}
        payload = {"prompt": prompt}

        # Send request
        res = requests.post(url, json=payload, headers=headers)
        res.raise_for_status()

        # Parse response
        data = res.json()

        print("✅ DATA RECEIVED FROM SERVER:")
        print(json.dumps(data, indent=2))

        # Extract each output list
        activities_json = data.get("activities_json", [])
        hourly_mets = data.get("hourly_metabolic_rates", [])
        hourly_acts = data.get("hourly_activities", [])
        hourly_furn = data.get("hourly_furniture", [])

        # Debug output lengths
        print("Hours:", len(hourly_mets), len(hourly_acts), len(hourly_furn))

    except Exception as e:
        print("❌ ERROR:", e)
        activities_json = [str(e)]

# Assign to Grasshopper outputs
a = activities_json
b = hourly_mets
c = hourly_acts
d = hourly_furn
# ---------- end python_3_script ----------
metabolic_rates = Panel(python_3_script.hourly_mets)
activities = Panel(python_3_script.hourly_acts)
furniture = Panel(python_3_script.hourly_furn)
